# Grasshopper definition BeaverTest.gh (Grasshopper 1.0.7)
# plug-ins: Kangaroo2 Components, Human, Karamba3D, Beaver, LunchBox, Human UI

# ----
# SELECT A BEAVER MATERIAL
path = FilePath("C:\Users\rprandini\source\repos\Beaver\Examples\BeaverMaterials.csv")
nickname = Comp_ImportCSVMaterials(FilePath=path)
panel = Panel(nickname)
item = ListItem(List=nickname, Index=Slider(27, range=0..40), Wrap=True)  # -> flatten(Item)

matselect = MaterialSelectionKaramba3D(menu=[dropdown(5), dropdown(2)])
layer_ref = LayerReference(ReferenceToggle=Toggle(True), LayerName="Spans")  # -> Geometry, Name, UserStrings, GUID

# ---- group: FORM FINDING
# mesh
# supports
# dome center
# attractor
# GEOMETRY GENERATION
number_slider = Slider(10, range=0..10)
number_slider_2 = Slider(3, range=0..10)
pt = Point("0,0,0")
X = UnitX(Factor=1)
pi = Pi(Factor="2")
line = LineSDL(Start=pt, Direction=X, Length=number_slider)
multiplication = Multiplication(A="2", B=number_slider_2)
division = Division(A=pi, B=multiplication)
rad = Radians(Degrees=Slider(30, range=0..180))
rotate = Rotate(Geometry=line, Angle=division, Plane=PlaneXY(0, 0, 0))  # -> Geometry, Transform
end = EndPoints(Curve=line)  # -> Start, End
end_2 = EndPoints(Curve=rotate.Geometry)  # -> Start, End
ln = Line(StartPoint=end.End, EndPoint=end_2.End)
eval = EvaluateCurve(Curve=rotate.Geometry, Parameter=Slider(0.3, range=0..1))  # -> Point, Tangent, Angle
eval_2 = EvaluateCurve(Curve=ln, Parameter=Slider(0.1, range=0..1))  # -> Point, Tangent, Angle
srf4pt = _4PointSurface(CornerA=end.Start, CornerB=eval.Point, CornerC=eval_2.Point, CornerD=end.End)
mesh = Mesh(srf4pt)
xz = XZPlane(Origin=Point(0, 0, 0))
mirror = Mirror(Geometry=mesh, Plane=xz)  # -> Geometry, Transform
pt_2 = Point(end_2.End)
mjoin = MeshJoin(Meshes=[mesh, mirror.Geometry])
arrpolar = PolarArray(Geometry=mjoin, Plane=PlaneXY(0, 0, 0), Count=number_slider_2, Angle=6.283185307)  # -> flatten(Geometry), Transform
mjoin_2 = MeshJoin(Meshes=arrpolar.Geometry)
arrpolar_2 = PolarArray(Geometry=mjoin_2, Plane=pt_2, Count=number_slider_2, Angle=6.283185307)  # -> Geometry, Transform
refine = Refine(Mesh=arrpolar_2.Geometry, Level="1")
pt_3 = Point(pt_2)  # disabled
number_slider_3 = Slider(10, range=0..10)  # disabled
nv = NakedVertices(Mesh=refine)  # -> ClothedIndex, NakedIndex, ClothedPts, NakedPts
area = Area(Geometry=refine)  # -> Area, Centroid
mjoin_3 = MeshJoin(Meshes=refine)  # disabled
Z = UnitZ(Factor=number_slider_3)  # disabled
number_slider_4 = Slider(0, range=0..1)  # disabled
move = Move(Geometry=pt_3, Motion=Z)  # -> Geometry, Transform; disabled
number_slider_5 = Slider(100, range=0..100)  # disabled
dist = Distance(PointA=nv.NakedPts, PointB=graft(area.Centroid))
nv_2 = NakedVertices(Mesh=mjoin_3)  # -> ClothedIndex, NakedIndex, ClothedPts, NakedPts; disabled
edgelengths = EdgeLengths(Mesh=mjoin_3, LengthFactor=number_slider_4, Strength=number_slider_5)  # disabled
cir = Circle(Plane=move.Geometry, Radius=1)  # disabled
show = Show(G=mjoin_3)  # disabled
larger = LargerThan(FirstNumber=dist, SecondNumber=Slider(8.8, range=0..10))  # -> LargerThan, OrEqualTo
cull = CullPattern(List=nv.NakedPts, CullPattern=larger.LargerThan)
dist_2 = Distance(PointA=nv.NakedPts, PointB=graft(pt_3))
cullpt = CullDuplicates(Points=cull, Tolerance=0.1, CullMode=3)  # -> flatten(Points), Indices, Valence
number_slider_6 = Slider(10, range=0..10)  # disabled
number_slider_7 = Slider(33, range=0..100)  # disabled
Z_2 = UnitZ(Factor=1)  # disabled
smaller = SmallerThan(FirstNumber=dist_2, SecondNumber=Slider(10, range=0..10))  # -> SmallerThan, OrEqualTo
cull_2 = CullPattern(List=nv.NakedPts, CullPattern=smaller.SmallerThan)  # disabled
panel_2 = Panel("1000000")  # disabled
load = Load(Point=nv_2.ClothedPts, ForceVector=Z_2, Weighting=number_slider_6)  # disabled
cullpt_2 = CullDuplicates(Points=cull_2, Tolerance=0.1, CullMode=3)  # -> flatten(Points), Indices, Valence; disabled
oncurve = OnCurve(Points=cullpt_2.Points, Curve=cir, Strength=number_slider_7)  # disabled
anchor = Anchor(Point=cullpt.Points, Strength=panel_2)  # disabled
button = Button()  # disabled
solver = Solver(GoalObjects=[edgelengths, show, anchor, load, oncurve], Reset=button, Threshold=1e-15, Tolerance=0.0001, On=True)  # -> I, V, O; disabled
sortbytype = SortObjectsByType(RhinoObjects=solver.O)  # -> Points, Curves, Surfaces, Breps, Meshes, TextObjects, HatchObjects, LightObjects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; disabled

# ----
mesh_2 = Mesh(flatten(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))
crv = Curve([<curve referenced from the Rhino model> x84])
matselect_2 = MaterialSelectionKaramba3D(menu=[dropdown(5), dropdown(1)])

# ----
# CONVERT IT INTO
# A KARAMBA MATERIAL
b2kmat = BeaverToKarambaMaterial(BeaverMaterial=item)

medges = MeshEdges(Mesh=mesh_2)  # -> NakedEdges, InteriorEdges, NonManifoldEdges

# ---- group: internal
crv_2 = Curve(medges.InteriorEdges)

# ---- group: edges
crv_3 = Curve(medges.NakedEdges)

# ----
cross_section = CrossSectionKaramba3D(FamilyNameOfCrossSection="DefaultCroSec", Material=matselect_2, Height_cm=1, mode="Shell - Const")

# ---- group: FINDS THE ACTUAL SPAN LENGTH FOR SLS ANALYSIS
midpt = CurveMiddle(Curve=crv_2)  # -> graft(Midpoint)
panel_3 = Panel("0.01")
crv_cp = CurveClosestPoint(Point=midpt, Curve=crv)  # -> Point, Parameter, Distance
end_3 = EndPoints(Curve=crv)  # -> Start, End
smaller_2 = SmallerThan(FirstNumber=crv_cp.Distance, SecondNumber=panel_3)  # -> SmallerThan, OrEqualTo
dist_3 = Distance(PointA=end_3.Start, PointB=end_3.End)
cull_3 = CullPattern(List=crv, CullPattern=smaller_2.OrEqualTo)  # -> flatten(List)
panel_4 = Panel(cull_3)

midpt_2 = CurveMiddle(Curve=crv_3)  # -> graft(Midpoint)
crv_cp_2 = CurveClosestPoint(Point=midpt_2, Curve=crv)  # -> Point, Parameter, Distance
end_4 = EndPoints(Curve=crv)  # -> Start, End
smaller_3 = SmallerThan(FirstNumber=crv_cp_2.Distance, SecondNumber=panel_3)  # -> SmallerThan, OrEqualTo
dist_4 = Distance(PointA=end_4.Start, PointB=end_4.End)
cull_4 = CullPattern(List=crv, CullPattern=smaller_3.OrEqualTo)  # -> flatten(List)
panel_5 = Panel(cull_4)

# ----
meshtoshell = MeshToShellKaramba3D(Mesh=mesh_2, CrossSection=cross_section, LimitDistance_m=0.005, Bending=False)  # -> Element, Points, Info
pt_4 = Point(cullpt.Points)
len = Length(Curve=medges.NakedEdges)
len_2 = Length(Curve=medges.InteriorEdges)
supp = SupportKaramba3D(PosInd=pt_4, menu=[buttons(on, on, on, off, off, off)])
cross_section_2 = CrossSectionKaramba3D(
    FamilyNameOfCrossSection="DefaultCroSec",
    Material=b2kmat,
    Height_cm="18",
    UpperFlangeWidth_cm="10",
    LowerFlangeWidth_cm="10",
    mode="Trapezoid")
cross_section_3 = CrossSectionKaramba3D(
    FamilyNameOfCrossSection="DefaultCroSec",
    Material=b2kmat,
    Height_cm="20",
    UpperFlangeWidth_cm="10",
    LowerFlangeWidth_cm="10",
    mode="Trapezoid")

# ---- group: CHECK IF IT WORKS
number_slider_8 = Slider(106, range=0..200)  # disabled
item_2 = ListItem(List=cull_4, Index=number_slider_8, Wrap=True)  # disabled
item_3 = ListItem(List=crv_3, Index=number_slider_8, Wrap=True)  # disabled
explode = Explode(Curve=item_2, Recursive=True)  # -> Segments, Vertices; disabled

# ----
loads = LoadsKaramba3D(Vector=Vector(0, 0, -1), LCase="P", mode="Gravity")
# ADD BEAVER
# PARAMETERS
# TO ELEMENTS
linetobeam = LineToBeamKaramba3D(
    Line=medges.InteriorEdges,
    Identifier="internal",
    CrossSection=cross_section_2,
    New=True,
    Remove=True,
    LimitDistance_m=0.005,
    Bending=True,
    SetBucklingLength=True,
    ToPolylineMaxAngle=0.03,
    ToPolylineTolerance=0.01,
    ToPolylineMinEdgeLength=0.25)  # -> Element, Points, Info
linetobeam_2 = LineToBeamKaramba3D(
    Line=medges.NakedEdges,
    Identifier="edges",
    CrossSection=cross_section_3,
    New=True,
    Remove=True,
    LimitDistance_m=0.005,
    Bending=True,
    SetBucklingLength=True,
    ToPolylineMaxAngle=0.03,
    ToPolylineTolerance=0.01,
    ToPolylineMinEdgeLength=0.25)  # -> Element, Points, Info
Z_3 = UnitZ(Factor="-0.3")
Z_4 = UnitZ(Factor="-1")
loads_2 = LoadsKaramba3D(Vector=Z_3, Mesh=mesh_2, LCase="W", mode="MeshLoad -Const.", menu=[buttons(off, off, on), buttons(on, off)])
loads_3 = LoadsKaramba3D(Vector=Z_4, Mesh=mesh_2, LCase="QA", mode="MeshLoad -Const.", menu=[buttons(off, off, on), buttons(on, off)])
addbeaverparams = KarambaAddBeaverParameters(
    Beam=linetobeam.Element,
    SpanLength=cull_3,
    BucklingLengthY=len_2,
    BucklingLengthZ=len_2,
    BucklingLengthLT=len_2,
    Cantilever=False,
    ServiceClass=2,
    Precamber=0,
    Local=True)
b2kbeams = KarambaAddBeaverParameters(
    Beam=linetobeam_2.Element,
    SpanLine=cull_4,
    BucklingLengthY=len,
    BucklingLengthZ=len,
    BucklingLengthLT=len_2,
    Cantilever=False,
    ServiceClass=2,
    Precamber=0,
    Local=False)
# RUN
# KARAMBA ANALYSIS
assemble = AssembleModelKaramba3D(
    Elem=[addbeaverparams, b2kbeams, meshtoshell.Element],
    Support=supp,
    Load=[loads, loads_3, loads_2],
    LimitDistance_m=0.005)  # -> Model, Info, Mass_kg, CenterOfGravity, LoadCaseNames
lng = ListLength(List=b2kbeams)
lng_2 = ListLength(List=addbeaverparams)
addition = Addition(A=lng_2, B=lng)
series = Series(Start=0, Step=1, Count=addition)
analyze = AnalyzeKaramba3D(Model=assemble.Model)  # -> CalculatedModel, MaximumDisplacement_cm, ResultingForceOfGravity_kN, ElasticEnergyChange_kNm
panel_6 = Panel("""P
QA
W""")
# DISPLAY KARAMBA RESULTS
modelview = ModelViewKaramba3D(Model=analyze.CalculatedModel, ResultFactors=1, ResultCase=-1)  # -> Model, DeformedMesh, DeformedAxes, DeformedModel

# ----
# BEAVER
# IMPORT TO BEAVER
panel_7 = Panel("""P
QA""")
k2b = KarambaToBeaver(
    KarambaModel=analyze.CalculatedModel,
    BeamIdentifiers=series,
    NumberOfResultsPerBeamElement="3",
    LoadCaseType=panel_6,
    Run=Toggle(True))

beamview = BeamViewKaramba3D(Model=modelview.Model)  # -> Model, MeshesOfRenderedBeams, DeformedBeamAxes, LegendColors, LegendTags
type = ValueList({"All", "SLS", "AllULS", "Tension", "Compression", "BiaxialBending", "Shear", "Torsion", "TensionAndBending", "CompressionAndBending", "CompressionAndBendingColumn", "CompressionAndBendingBeam", "TorsionAndShear"}, selected="All")
legend = Legend(
    Colour=beamview.LegendColors,
    Tags=beamview.LegendTags,
    Rectangle={Plane=PlaneXY(-10.2767964, 8.52262475, 0), Size=Domain2(u=-1.919640395..1.919640395, v=-5.028908498..5.028908498)},
    LegendType=1)
nickname_2 = TimberFrameView(TimberFrames=k2b, UtilizationType=type)  # -> TimberFrames, Mesh, LegendT, LegendC, MaximumUtilization
criticalcheck = VisualizeCriticalCheck(TimberFrames=k2b)  # -> TimberFrames, Mesh, LegendT, LegendC
data = Data(criticalcheck.TimberFrames)
col = Colour(criticalcheck.LegendC)
mesh_3 = Mesh(criticalcheck.Mesh)
txt = Text(criticalcheck.LegendT)
mesh_4 = Mesh(sortbytype.Meshes)  # disabled
medges_2 = MeshEdges(Mesh=mesh_3)  # -> NakedEdges, InteriorEdges, NonManifoldEdges
list = ValueList({"Utilization", "Critical Check"}, selected="Utilization")
crv_4 = Curve([medges_2.NakedEdges, medges_2.InteriorEdges, medges_2.NonManifoldEdges])
numericresults = ViewNumericResults(
    TimberFrames=data,
    ValueType=list,
    TextColour=ColourSwatch(SwatchColor=RGB(82, 82, 82)),
    TextSize=Slider(0.064, range=0..1))  # -> Info, Points
preview = CustomPreview(Geometry=crv_4, Material=ColourSwatch(SwatchColor=RGB(171, 171, 171)))
tag = TextTag(Location=numericresults.Points, Text=numericresults.Info)

# ----
# LEGEND
expression = Expression(x=nickname_2.MaximumUtilization, Expression="Format(\"{0}{1:0,#} {2}\",\"Max Utilization: \", x*100,\"%\")")
txt_2 = Text(txt)
col_2 = Colour(col)
launchxpwin = LaunchTransparentWindow(Show=Toggle(True), Name="Legend", Width=370, Height=500, ChildStatus=0, EnableHorizScroll=False)
textbox = CreateTextBox(DefaultText=txt_2, UpdateButton=False, showLabel=True)
label = CreateLabel(LabelText=expression, LabelSize=12, Justification=0)
c_script = CSharpScript(x=col_2)  # -> A; inputs x: list of Color
# ---------- c_script: C# usings ----------
using System.Drawing;
# ---------- c_script: C# ----------
    List<Color> out_colors = new List<Color>();
    foreach(Color colorL in x){
      Color out_color = colorL.GetBrightness() > 0.4 ? Color.Black : Color.White;
      out_colors.Add(out_color);
    }
    A = out_colors;
# ---------- end c_script ----------
panel_8 = Panel("25,100")
addelems = AddElements(Window=launchxpwin, Elements=flatten([textbox, label]), DoVLChecking=True)  # -> AddedElements, ElementNames
winprops = SetWindowProperties(Window=launchxpwin, ShowTitleBar=Toggle(False), ScaleFactor=Slider(0.7, range=0..1))
adjustelem = AdjustElementAppearance(ElementsToAdjust=textbox, Foreground=c_script, Background=col_2, FontSize=Slider(18, range=0..100))
