# Grasshopper definition Parametric Grid + MomentStiff.gh (Grasshopper 1.0.7)
# plug-ins: Karamba3D, Beaver, Human UI

a1v = Slider(0.04, range=0..0.1)
npar = Slider(2, range=0..10)
nperp = Slider(4, range=0..10)
a1h = Slider(0.04, range=0..0.1)
pt = Point(Point(-0.04814835679, 0.1279242541, -0.03806634227))
bmat = Material(
    Name="GL24c",
    Type="Glulam",
    BendingResistance=24,
    ParallelTensionResistence=17,
    PerpendicularTensionResistence=0.5,
    PalallelCompressionResistence=21.5,
    PerpendicularCompressionResistence=2.5,
    ShearResistence=3.5,
    MeanModulusOfElasticityParallel=11000,
    _5ModulusOfElasticityParallel=9100,
    MeanModulusOfElasticityPerpendicular=300,
    MeanModulusOfElasticityShear=650,
    _5ModulusOfElasticityShear=540)
x_spacing = Slider(0.3, range=0..1)
x = Slider(3, range=0..10)
y = Slider(2, range=0..10)
adjacent = Slider(3, range=1..5)
path = FilePath("C:\Users\rprandini\source\repos\Beaver\Examples\BeaverMaterials.csv")
number_slider = Slider(96, range=0..150)
path_2 = FilePath("C:\Users\rprandini\source\repos\Beaver\Examples\BeaverMaterials.csv")
number_slider_2 = Slider(10, range=0..10)
series = Series(Start=0, Step=a1v, Count=npar)
importcsvmat = ImportCSVMaterials(FilePath=path)
panel = Panel(importcsvmat)
type = ValueList({"Rectangular": "rectangular", "Circular": "circular"}, selected="Rectangular")
type_2 = ValueList({"Dowel", "Screw", "Bolt", "Nail"}, selected="Nail")
series_2 = Series(Start=0, Step=a1h, Count=nperp)
dom = ConstructDomain(DomainStart=0, DomainEnd=x)
dom_2 = ConstructDomain(DomainStart=0, DomainEnd=y)
addition = Addition(A=adjacent, B=1)
Y = UnitY(Factor=series)
X = UnitX(Factor=1)
Z = UnitZ(Factor=series_2)
importcsvmat_2 = ImportCSVMaterials(FilePath=path_2)
panel_2 = Panel(importcsvmat_2)
division = Division(A=x, B=x_spacing)
rectangle = Rectangle(Plane=PlaneXY(0, 0, 0), XSize=dom, YSize=dom_2, Radius=0)  # -> Rectangle, Length
move = Move(Geometry=pt, Motion=Y)  # -> graft(Geometry), Transform
fast = Fastener(
    FastenerType=type_2,
    NominalDiameter=Slider(2, range=0..12),
    ShankDiameter=Slider(8, range=0..12),
    HeadDiameter=Slider(8, range=0..12),
    FastenerLength=number_slider,
    SmoothBoolean=False,
    FastenerFu=400,
    FastenerThreadedLength=number_slider)
force = Force(
    NormalForce=Slider(0, range=-5..5),
    ShearForceY=Slider(0, range=-5..5),
    ShearForceZ=Slider(-7, range=-10..10),
    TorsionalMoment=Slider(0, range=-5..5),
    BendingMomentY=Slider(0, range=-5..5),
    BendingMomentZ=Slider(0, range=-5..5),
    LoadCaseType="P")
disp = Comp_Displacement(DisplacementX=0, DisplacementY=0, DisplacementZ=0, LoadCaseType="P")
move_2 = Move(Geometry=move.Geometry, Motion=Z)  # -> Geometry, Transform
sdivide = DivideSurface(Surface=rectangle.Rectangle, UCount=division, VCount=1)  # -> Points, Normals, Parameters
series_3 = Series(Start=0, Step=y, Count=adjacent)
series_4 = Series(Start=0, Step=y, Count=addition)
item = ListItem(List=importcsvmat, Index=Slider(5, range=0..35), Wrap=True)
cs = CrossSection(Type=type, Material=item, Height=number_slider_2, Width=number_slider_2)
pt_2 = Point(flatten(move_2.Geometry))
yz = YZPlane(Origin=Point(0, 0, 0))
xz = XZPlane(Origin=Point(0, 0, 0))
flip = FlipMatrix(Data=sdivide.Points)
item_2 = ListItem(List=importcsvmat_2, Index=Slider(5, range=0..35), Wrap=True)
item_3 = ListItem(List=importcsvmat_2, Index=Slider(30, range=0..35), Wrap=True)
panel_3 = Panel(item)
pline = PolyLine(Vertices=sdivide.Points, Closed=False)  # -> flatten(Polyline)
pline_2 = PolyLine(Vertices=flip, Closed=False)  # -> flatten(Polyline)
Y_2 = UnitY(Factor=series_3)
Y_3 = UnitY(Factor=series_4)
spacings = ShearConnectionSpacings(Npar=npar, Nperp=nperp, Stagger=False, A1=a1v, A2=a1v, A3=a1v, A4=a1v, Plane=yz)
framepoint = TimberFramePoint(
    CrossSection=cs,
    Forces=force,
    DisplacementVector=disp,
    BucklingLenghtY=3,
    BucklingLenghtZ=3,
    SpanLenght=3,
    PreCamber=0,
    Cantilever=False,
    SpanLimitRange=0.5,
    ServiceClass="2")
t2t = TimberToTimberConnection(
    Fastener=fast,
    PreDrilled1="true",
    PreDrilled2="true",
    Alpha1="0",
    Alpha2="90",
    T1="48",
    T2="48",
    Mat1=item,
    Mat2=item,
    ShearPlanes="1",
    RopeEffect="true")  # -> FastenerCapacity, Fastener, ShearCapacities, AxialCapacities
b2kmat = BeaverToKarambaMaterial(BeaverMaterial=item_2)
panel_4 = Panel(item_2)
b2kmat_2 = BeaverToKarambaMaterial(BeaverMaterial=item_3)
panel_5 = Panel(item_3)
move_3 = Move(Geometry=pline, Motion=graft(Y_2))  # -> flatten(Geometry), Transform
item_4 = ListItem(List=pline_2, Index=0, Wrap=True)
move_4 = Move(Geometry=item_4, Motion=graft(Y_3))  # -> flatten(Geometry), Transform
explode = Explode(Curve=move_4.Geometry, Recursive=True)  # -> Segments, Vertices
lng = ListLength(List=explode.Segments)
repeat = RepeatData(Data=move_4.Geometry, Length=flatten(lng))
characteristic_capacities = Panel(t2t.AxialCapacities)
list = ValueList({"N", "Vz", "Vy", "Shear", "Axial", "Combined"}, selected="Shear")
end = EndPoints(Curve=move_4.Geometry)  # -> Start, End
list_2 = ValueList({"Faxd", "Fvd", "Fx", "Fy", "Fz", "Fi_My", "Fi_Mt"}, selected="Fvd")
pt_3 = Point([end.Start, end.End])
semirigidconnection = SemiRigidConnection(
    Plane=yz,
    Points=pt_2,
    Fastener=t2t.Fastener,
    Spacing=spacings,
    TimberFramePoint=framepoint,
    ForceType=list_2,
    AnalysisType=list)  # -> Points, Vector, Value, Utilization, Mesh, TranslationalStiffness, RotationalStiffness
panel_6 = Panel("""Black
165, 0, 38
215,48,39
244,109,67
253,174,97
254,224,144
255,255,191
224,243,248
171,217,233
116,173,209
69,117,180
49,54,149""")
kθ = Panel(semirigidconnection.RotationalStiffness)
panel_7 = Panel("""0%
10%
20%
30%
40%
50%
60%
70%
80%
90%
100%
>100%""")
scale = Slider(40, range=0..100)

# ----
# Primary Beams
height = Slider(40, range=0..100)
width = Slider(14, range=1..100)
cross_section = CrossSectionKaramba3D(
    FamilyNameOfCrossSection="DefaultCroSec",
    Color=ColourSwatch(SwatchColor=RGB(153, 115, 66)),
    Material=b2kmat_2,
    Height_cm=height,
    UpperFlangeWidth_cm=width,
    LowerFlangeWidth_cm=width,
    mode="Trapezoid")
linetobeam = LineToBeamKaramba3D(
    Line=explode.Segments,
    Identifier="Primary",
    CrossSection=cross_section,
    New=True,
    Remove=True,
    LimitDistance_m=0.005,
    Bending=True,
    SetBucklingLength=True,
    ToPolylineMaxAngle=0.03,
    ToPolylineTolerance=0.01,
    ToPolylineMinEdgeLength=0.25)  # -> Element, Points, Info
len = Length(Curve=explode.Segments)
b2kbeams = KarambaAddBeaverParameters(
    Beam=simplify(linetobeam.Element),
    SpanLine=simplify(repeat),
    BucklingLengthY=simplify(len),
    BucklingLengthZ=simplify(len),
    BucklingLengthLT=simplify(len),
    Cantilever=False,
    ServiceClass=1,
    Precamber=0,
    Local=False)  # -> flatten(Beam)

# ----
# Secondary Beams
height_2 = Slider(20, range=0..100)
width_2 = Slider(4.8, range=1..100)
cross_section_2 = CrossSectionKaramba3D(
    FamilyNameOfCrossSection="DefaultCroSec",
    Color=ColourSwatch(SwatchColor=RGB(199, 177, 149)),
    Material=b2kmat,
    Height_cm=height_2,
    UpperFlangeWidth_cm=width_2,
    LowerFlangeWidth_cm=width_2,
    mode="Trapezoid")
linetobeam_2 = LineToBeamKaramba3D(
    Line=move_3.Geometry,
    Identifier="Secondary",
    CrossSection=cross_section_2,
    New=True,
    Remove=True,
    LimitDistance_m=0.005,
    Bending=True,
    SetBucklingLength=True,
    ToPolylineMaxAngle=0.03,
    ToPolylineTolerance=0.01,
    ToPolylineMinEdgeLength=0.25)  # -> Element, Points, Info
len_2 = Length(Curve=move_3.Geometry)
crv = Curve(move_3.Geometry)
b2kbeams_2 = KarambaAddBeaverParameters(
    Beam=linetobeam_2.Element,
    SpanLine=crv,
    BucklingLengthY=len_2,
    BucklingLengthZ=len_2,
    BucklingLengthLT=len_2,
    Cantilever=False,
    ServiceClass=1,
    Precamber=0,
    Local=True)  # -> flatten(Beam)

vlen = VectorLength(Vector=semirigidconnection.Vector)  # -> expr("round(x,2)", Length)
num = Number(expr("round(x,2)", semirigidconnection.Utilization))
division_2 = Division(A=semirigidconnection.Vector, B=scale)
col = Colour(reverse(panel_6))

# ----
# LEGEND
expression = Expression(Expression="Format(\"{0}{1:0,#} {2}\",\"Max Utilization: \", x*100,\"%\")")
txt = Text(panel_7)
col_2 = Colour(col)
toggle = BooleanToggle(True)
launchxpwin = LaunchTransparentWindow(Show=toggle, Name="Legend", Width=370, Height=500, ChildStatus=0, EnableHorizScroll=False)
textbox = CreateTextBox(DefaultText=txt, UpdateButton=False, showLabel=True)
label = CreateLabel(LabelText=expression, LabelSize=12, Justification=0)
c_script = CSharpScript(x=col_2)  # -> A; inputs x: list of Color
# ---------- c_script: C# usings ----------
using System.Drawing;
# ---------- c_script: C# ----------
    List<Color> out_colors = new List<Color>();
    foreach(Color colorL in x){
      Color out_color = colorL.GetBrightness() > 0.4 ? Color.Black : Color.White;
      out_colors.Add(out_color);
    }
    A = out_colors;
# ---------- end c_script ----------
panel_8 = Panel("25,100")
addelems = AddElements(Window=launchxpwin, Elements=flatten([textbox, label]), DoVLChecking=True)  # -> AddedElements, ElementNames
winprops = SetWindowProperties(Window=launchxpwin, ShowTitleBar=toggle, ScaleFactor=1)
adjustelem = AdjustElementAppearance(ElementsToAdjust=textbox, Foreground=c_script, Background=col_2)

mesh = Mesh(semirigidconnection.Mesh)
pt_4 = Point(semirigidconnection.Points)
move_5 = Move(Geometry=pt_4, Motion=division_2)  # -> Geometry, Transform
medges = MeshEdges(Mesh=mesh)  # -> NakedEdges, InteriorEdges, NonManifoldEdges
ma = MassAddition(Input=vlen)  # -> Result, PartialResults
vdis = VectorDisplay(Anchor=pt_4, Vector=division_2)
sum_of_forces = Panel(ma.Result)
tag = TextTag(Location=move_5.Geometry, Text=vlen, Colour=ColourSwatch(SwatchColor=RGB(0, 0, 0)))
panel_9 = Panel("{0,0,0}")
vec = VectorXYZ(XComponent=0, YComponent=kθ, ZComponent=0)  # -> Vector, Length
data = Data("Secondary")
beam_joints = BeamJointsKaramba3D(
    AtElementIdentifiers="Secondary",
    CtKNMAtStartingNode=Vector(0, 0, 0),
    CrKNmRadAtStartingNode=vec.Vector,
    CtKNMAtEndNode=Vector(0, 0, 0),
    CrKNmRadAtEndNode=vec.Vector,
    menu=[buttons(off, off, off, on, on, on), buttons(off, off, off, off, on, on)])
supp = SupportKaramba3D(PosInd=pt_3, menu=[buttons(on, on, on, on, off, off)])
data_2 = Data([b2kbeams, b2kbeams_2])
perm_weight = Panel("P")
accidental = Panel("QA")
Z_2 = UnitZ(Factor=expr("-x", Slider(1.8, range=0..10)))
Z_3 = UnitZ(Factor=expr("-x", Slider(2.8, range=0..10)))
Z_4 = UnitZ(Factor=expr("-x", Slider(1.4, range=0..10)))
Z_5 = UnitZ(Factor=expr("-x", Slider(1.1, range=0..10)))
snow = Panel("S")
wind = Panel("W")
beam_loads = BeamLoadsKaramba3D(BeamIdentifier=data, LoadCase=wind, ForceVector=Z_5, TStart=0, TEnd=1, mode="Block", menu=[buttons(off, off, on)])
beam_loads_2 = BeamLoadsKaramba3D(BeamIdentifier=data, LoadCase=snow, ForceVector=Z_2, TStart=0, TEnd=1, mode="Block", menu=[buttons(off, off, on)])
beam_loads_3 = BeamLoadsKaramba3D(BeamIdentifier=data, LoadCase=perm_weight, ForceVector=Z_3, TStart=0, TEnd=1, mode="Block", menu=[buttons(off, off, on)])
beam_loads_4 = BeamLoadsKaramba3D(BeamIdentifier=data, LoadCase=accidental, ForceVector=Z_4, TStart=0, TEnd=1, mode="Block", menu=[buttons(off, off, on)])
panel_10 = Panel(beam_joints)
assemble = AssembleModelKaramba3D(
    Elem=data_2,
    Support=supp,
    Load=[beam_loads_3, beam_loads_4, beam_loads, beam_loads_2],
    Joint=beam_joints,
    LimitDistance_m=0.005)  # -> Model, Info, Mass_kg, CenterOfGravity, LoadCaseNames
lng_2 = ListLength(List=data_2)
series_5 = Series(Start=0, Step=1, Count=lng_2)
n = Slider(4, range=2..14)
analyze = AnalyzeKaramba3D(Model=assemble.Model)  # -> CalculatedModel, MaximumDisplacement_cm, ResultingForceOfGravity_kN, ElasticEnergyChange_kNm
panel_11 = Panel("secondary")
panel_12 = Panel("""P
QA
W
S""")
modelview = ModelViewKaramba3D(Model=analyze.CalculatedModel, ResultFactors=1, ResultCase=-1)  # -> Model, DeformedMesh, DeformedAxes, DeformedModel
type_3 = ValueList({"All", "SLS", "AllULS", "Tension", "Compression", "BiaxialBending", "Shear", "Torsion", "TensionAndBending", "CompressionAndBending", "CompressionAndBendingColumn", "CompressionAndBendingBeam", "TorsionAndShear"}, selected="All")
k2b = KarambaToBeaver(
    KarambaModel=analyze.CalculatedModel,
    BeamIdentifiers=series_5,
    NumberOfResultsPerBeamElement=n,
    LoadCaseType=panel_12,
    Run=Toggle(True))
nickname = TimberFrameView(TimberFrames=k2b, UtilizationType=type_3)  # -> TimberFrames, Mesh, LegendT, LegendC, MaximumUtilization
beamview = BeamViewKaramba3D(Model=modelview.Model)  # -> Model, MeshesOfRenderedBeams, DeformedBeamAxes, LegendColors, LegendTags
criticalcheck = VisualizeCriticalCheck(TimberFrames=k2b)  # -> TimberFrames, Mesh, LegendT, LegendC
data_3 = Data(nickname.TimberFrames)
col_3 = Colour(nickname.LegendC)
mesh_2 = Mesh(nickname.Mesh)
txt_2 = Text(nickname.LegendT)
medges_2 = MeshEdges(Mesh=mesh_2)  # -> NakedEdges, InteriorEdges, NonManifoldEdges
list_3 = ValueList({"Utilization", "Critical Check"}, selected="Utilization")
crv_2 = Curve([medges_2.NakedEdges, medges_2.InteriorEdges, medges_2.NonManifoldEdges])
numericresults = ViewNumericResults(
    TimberFrames=data_3,
    ValueType=list_3,
    TextColour=ColourSwatch(SwatchColor=RGB(82, 82, 82)),
    TextSize=Slider(0.1, range=0..1))  # -> Info, Points
preview = CustomPreview(Geometry=crv_2, Material=ColourSwatch(SwatchColor=RGB(171, 171, 171)))
tag_2 = TextTag(Location=numericresults.Points, Text=numericresults.Info)

# ----
# LEGEND
expression_2 = Expression(x=nickname.MaximumUtilization, Expression="Format(\"{0}{1:0,#} {2}\",\"Max Utilization: \", x*100,\"%\")")
txt_3 = Text(txt_2)
col_4 = Colour(col_3)
toggle_2 = BooleanToggle(True)
launchxpwin_2 = LaunchTransparentWindow(Show=toggle_2, Name="Legend", Width=370, Height=500, ChildStatus=0, EnableHorizScroll=False)
textbox_2 = CreateTextBox(DefaultText=txt_3, UpdateButton=False, showLabel=True)
label_2 = CreateLabel(LabelText=expression_2, LabelSize=12, Justification=0)
c_script_2 = CSharpScript(x=col_4)  # -> A; inputs x: list of Color; same code as c_script
addelems_2 = AddElements(Window=launchxpwin_2, Elements=flatten([textbox_2, label_2]), DoVLChecking=True)  # -> AddedElements, ElementNames
winprops_2 = SetWindowProperties(Window=launchxpwin_2, ShowTitleBar=toggle_2, ScaleFactor=1)
adjustelem_2 = AdjustElementAppearance(ElementsToAdjust=textbox_2, Foreground=c_script_2, Background=col_4)
