# Grasshopper definition ShearConnection.gh (Grasshopper 1.0.7)
# plug-ins: Beaver, Human UI, Pufferfish

a1v = Slider(0.08, range=0..0.1)
npar = Slider(3, range=0..10)
nperp = Slider(4, range=0..10)
a1h = Slider(0.08, range=0..0.1)
bmat = Material(
    Name="GL24c",
    Type="Glulam",
    BendingResistance=24,
    ParallelTensionResistence=17,
    PerpendicularTensionResistence=0.5,
    PalallelCompressionResistence=21.5,
    PerpendicularCompressionResistence=2.5,
    ShearResistence=3.5,
    MeanModulusOfElasticityParallel=11000,
    _5ModulusOfElasticityParallel=9100,
    MeanModulusOfElasticityPerpendicular=300,
    MeanModulusOfElasticityShear=650,
    _5ModulusOfElasticityShear=540)
path = FilePath("C:\Users\rprandini\source\repos\Beaver\Examples\BeaverMaterials.csv")
number_slider = Slider(96, range=0..150)
pt = Point(Point(0, 0, 0))
number_slider_2 = Slider(10, range=0..10)
type = ValueList({"Rectangular": "rectangular", "Circular": "circular"}, selected="Rectangular")
type_2 = ValueList({"Dowel", "Screw", "Bolt", "Nail"}, selected="Screw")
importcsvmat = ImportCSVMaterials(FilePath=path)
panel = Panel(importcsvmat)
arrange_fast = ARRANGEFAST(G=pt, N=a1v, C=npar, N_2=a1h, C_2=nperp)
fast = Fastener(
    FastenerType=type_2,
    NominalDiameter=Slider(8, range=0..12),
    ShankDiameter=Slider(8, range=0..12),
    HeadDiameter=Slider(8, range=0..12),
    FastenerLength=number_slider,
    SmoothBoolean=False,
    FastenerFu=400,
    FastenerThreadedLength=number_slider)
force = Force(
    NormalForce=Slider(1, range=-5..5),
    ShearForceY=Slider(0, range=-5..5),
    ShearForceZ=Slider(-5, range=-5..5),
    TorsionalMoment=Slider(0, range=-5..5),
    BendingMomentY=Slider(1, range=-5..5),
    BendingMomentZ=Slider(0, range=-5..5),
    LoadCaseType="P")
disp = Comp_Displacement(DisplacementX=0, DisplacementY=0, DisplacementZ=0, LoadCaseType="P")
item = ListItem(List=importcsvmat, Index=Slider(29, range=0..35), Wrap=True)
cs = CrossSection(Type=type, Material=item, Height=number_slider_2, Width=number_slider_2)
xz = XZPlane(Origin=Point(0, 0, 0))
panel_2 = Panel(item)
spacings = ShearConnectionSpacings(Npar=npar, Nperp=nperp, Stagger=False, A1=a1v, A2=a1v, A3=a1v, A4=a1v, Plane=xz)
framepoint = TimberFramePoint(
    CrossSection=cs,
    Forces=force,
    DisplacementVector=disp,
    BucklingLenghtY=3,
    BucklingLenghtZ=3,
    SpanLenght=3,
    PreCamber=0,
    Cantilever=False,
    SpanLimitRange=0.5,
    ServiceClass="2")
t2t = TimberToTimberConnection(
    Fastener=fast,
    PreDrilled1="true",
    PreDrilled2="true",
    Alpha1="0",
    Alpha2="90",
    T1="48",
    T2="48",
    Mat1=item,
    Mat2=item,
    ShearPlanes="1",
    RopeEffect="true")  # -> FastenerCapacity, Fastener, ShearCapacities, AxialCapacities
characteristic_capacities = Panel(t2t.AxialCapacities)
list = ValueList({"N", "Vz", "Vy", "Shear", "Axial", "Combined"}, selected="Shear")
list_2 = ValueList({"Faxd", "Fvd", "Fx", "Fy", "Fz", "Fi_My", "Fi_Mt"}, selected="Fvd")
semirigidconnection = SemiRigidConnection(
    Plane=xz,
    Points=arrange_fast,
    Fastener=t2t.Fastener,
    Spacing=spacings,
    TimberFramePoint=framepoint,
    ForceType=list_2,
    AnalysisType=list)  # -> Points, Vector, Value, Utilization, Mesh, TranslationalStiffness, RotationalStiffness
panel_3 = Panel("""Black
165, 0, 38
215,48,39
244,109,67
253,174,97
254,224,144
255,255,191
224,243,248
171,217,233
116,173,209
69,117,180
49,54,149""")
kθ = Panel(semirigidconnection.RotationalStiffness)
panel_4 = Panel("""0%
10%
20%
30%
40%
50%
60%
70%
80%
90%
100%
>100%""")
scale = Slider(24, range=0..100)
vlen = VectorLength(Vector=semirigidconnection.Vector)  # -> expr("round(x,2)", Length)
num = Number(expr("round(x,2)", semirigidconnection.Utilization))
division = Division(A=semirigidconnection.Vector, B=scale)
col = Colour(reverse(panel_3))
pt_2 = Point(semirigidconnection.Points)
mesh = Mesh(semirigidconnection.Mesh)
max = Maximum()
move = Move(Geometry=pt_2, Motion=division)  # -> Geometry, Transform
panel_5 = Panel("Utilization")
medges = MeshEdges(Mesh=mesh)  # -> NakedEdges, InteriorEdges, NonManifoldEdges
ma = MassAddition(Input=vlen)  # -> Result, PartialResults
vdis = VectorDisplay(Anchor=pt_2, Vector=division)
hilonums = HighestLowestNumbers(Numbers=num)  # -> Highest, Lowest
sum_of_forces = Panel(ma.Result)
tag = TextTag(Location=move.Geometry, Text=vlen, Colour=ColourSwatch(SwatchColor=RGB(0, 0, 0)))
preview = CustomPreview(Geometry=[medges.NakedEdges, medges.InteriorEdges], Material=ColourSwatch(SwatchColor=RGB(158, 158, 158)))

# ----
# LEGEND
expression = Expression(x=hilonums.Highest, Expression="Format(\"{0}{1:0,#} {2}\",\"Max Utilization: \", x*100,\"%\")")
txt = Text(panel_4)
col_2 = Colour(col)
launchxpwin = LaunchTransparentWindow(Show=Toggle(True), Name="Legend", Width=370, Height=500, ChildStatus=0, EnableHorizScroll=False)
textbox = CreateTextBox(DefaultText=txt, UpdateButton=False, showLabel=True)
label = CreateLabel(LabelText=expression, LabelSize=12, Justification=0)
c_script = CSharpScript(x=col_2)  # -> A; inputs x: list of Color
# ---------- c_script: C# usings ----------
using System.Drawing;
# ---------- c_script: C# ----------
    List<Color> out_colors = new List<Color>();
    foreach(Color colorL in x){
      Color out_color = colorL.GetBrightness() > 0.4 ? Color.Black : Color.White;
      out_colors.Add(out_color);
    }
    A = out_colors;
# ---------- end c_script ----------
panel_6 = Panel("25,100")
addelems = AddElements(Window=launchxpwin, Elements=flatten([label, textbox]), DoVLChecking=True)  # -> AddedElements, ElementNames
winprops = SetWindowProperties(Window=launchxpwin, ShowTitleBar=Toggle(False), ScaleFactor=Slider(1, range=0..1))
adjustelem = AdjustElementAppearance(ElementsToAdjust=textbox, Foreground=c_script, Background=col_2)

# ==== cluster ARRANGEFAST
N = ClusterInput()
C = ClusterInput()
N_2 = ClusterInput()
C_2 = ClusterInput()
series = Series(Start=0, Step=N, Count=C)
series_2 = Series(Start=0, Step=N_2, Count=C_2)
G = ClusterInput()
X = UnitX(Factor=series)
Z = UnitZ(Factor=series_2)
move = Move(Geometry=G, Motion=X)  # -> graft(Geometry), Transform
move_2 = Move(Geometry=move.Geometry, Motion=Z)  # -> Geometry, Transform
pt = Point(flatten(move_2.Geometry))
pt_2 = ClusterOutput(pt)
