# Grasshopper definition SimplySuportedBeam.gh (Grasshopper 1.0.7)
# plug-ins: Karamba3D, Beaver, Human UI

number_slider = Slider(0.4, range=0..10)
X = UnitX(Factor=1)
path = FilePath("C:\Users\rprandini\source\repos\Beaver\Examples\BeaverMaterials.csv")
pt = ConstructPoint(XCoordinate=0, YCoordinate=0, ZCoordinate=0)
height = Slider(18, range=0..100)
width = Slider(14, range=1..100)
line = LineSDL(Start=pt, Direction=X, Length=number_slider)
move = Move(Geometry=line, Motion=Vector(0, 0.233837655, 0))  # -> Geometry, Transform
linedim = LineDimension(Line=move.Geometry, Text="{0:0.00}", Size=Slider(0.1, range=0..1))
end = EndPoints(Curve=line)  # -> Start, End
importcsvmat = ImportCSVMaterials(FilePath=path)
panel = Panel(importcsvmat)
pt_2 = Point([end.Start, end.End])
item = ListItem(List=importcsvmat, Index=Slider(30, range=0..35), Wrap=True)
b2kmat = BeaverToKarambaMaterial(BeaverMaterial=item)
cross_section = CrossSectionKaramba3D(
    FamilyNameOfCrossSection="DefaultCroSec",
    Material=b2kmat,
    Height_cm=height,
    UpperFlangeWidth_cm=width,
    LowerFlangeWidth_cm=width,
    mode="Trapezoid")
panel_2 = Panel(item)
supp = SupportKaramba3D(PosInd=pt_2, menu=[buttons(on, on, on, on, off, off)])
linetobeam = LineToBeamKaramba3D(
    Line=line,
    CrossSection=cross_section,
    New=True,
    Remove=True,
    LimitDistance_m=0.005,
    Bending=True,
    SetBucklingLength=True,
    ToPolylineMaxAngle=0.03,
    ToPolylineTolerance=0.01,
    ToPolylineMinEdgeLength=0.25)  # -> Element, Points, Info
perm_weight = Panel("P")
accidental = Panel("QA")
Z = UnitZ(Factor=expr("-x", Slider(0, range=0..10)))
Z_2 = UnitZ(Factor=expr("-x", Slider(0, range=0..10)))
Z_3 = UnitZ(Factor=expr("-x", Slider(0, range=0..10)))
Z_4 = UnitZ(Factor=expr("-x", Slider(0, range=0..10)))
snow = Panel("S")
wind = Panel("W")
b2kbeams = KarambaAddBeaverParameters(
    Beam=linetobeam.Element,
    SpanLine=line,
    BucklingLengthY=number_slider,
    BucklingLengthZ=number_slider,
    BucklingLengthLT=number_slider,
    Cantilever=False,
    ServiceClass=1,
    Precamber=0,
    Local=False)
beam_loads = BeamLoadsKaramba3D(LoadCase=wind, ForceVector=Z_4, TStart=0, TEnd=1, mode="Block", menu=[buttons(off, off, on)])
beam_loads_2 = BeamLoadsKaramba3D(LoadCase=snow, ForceVector=Z, TStart=0, TEnd=1, mode="Block", menu=[buttons(off, off, on)])
beam_loads_3 = BeamLoadsKaramba3D(LoadCase=perm_weight, ForceVector=Z_2, TStart=0, TEnd=1, mode="Block", menu=[buttons(off, off, on)])
beam_loads_4 = BeamLoadsKaramba3D(LoadCase=accidental, ForceVector=Z_3, TStart=0, TEnd=1, mode="Block", menu=[buttons(off, off, on)])
Z_5 = UnitZ(Factor="-28")
beam_loads_5 = BeamLoadsKaramba3D(LoadCase=perm_weight, ForceVector=Z_5, TPosition=0.5, mode="Concentrated", menu=[buttons(off, on)])
assemble = AssembleModelKaramba3D(
    Elem=b2kbeams,
    Support=supp,
    Load=[beam_loads_3, beam_loads_4, beam_loads, beam_loads_2, beam_loads_5],
    LimitDistance_m=0.005)  # -> Model, Info, Mass_kg, CenterOfGravity, LoadCaseNames
n = Slider(4, range=2..14)
analyze = AnalyzeKaramba3D(Model=assemble.Model)  # -> CalculatedModel, MaximumDisplacement_cm, ResultingForceOfGravity_kN, ElasticEnergyChange_kNm
panel_3 = Panel("""P
QA
W
S""")
k2b = KarambaToBeaver(
    KarambaModel=analyze.CalculatedModel,
    BeamIdentifiers="0",
    NumberOfResultsPerBeamElement=n,
    LoadCaseType=panel_3,
    Run=Toggle(True))
modelview = ModelViewKaramba3D(Model=analyze.CalculatedModel, ResultFactors=1, ResultCase=-1)  # -> Model, DeformedMesh, DeformedAxes, DeformedModel
type = ValueList({"All", "SLS", "AllULS", "Tension", "Compression", "BiaxialBending", "Shear", "Torsion", "TensionAndBending", "CompressionAndBending", "CompressionAndBendingColumn", "CompressionAndBendingBeam", "TorsionAndShear"}, selected="All")
beamview = BeamViewKaramba3D(Model=modelview.Model)  # -> Model, MeshesOfRenderedBeams, DeformedBeamAxes, LegendColors, LegendTags
nickname = TimberFrameView(TimberFrames=k2b, UtilizationType=type)  # -> TimberFrames, Mesh, LegendT, LegendC, MaximumUtilization
criticalcheck = VisualizeCriticalCheck(TimberFrames=k2b)  # -> TimberFrames, Mesh, LegendT, LegendC
data = Data(nickname.TimberFrames)
mesh = Mesh(nickname.Mesh)
txt = Text(nickname.LegendT)
col = Colour(nickname.LegendC)

# ----
# LEGEND
expression = Expression(x=nickname.MaximumUtilization, Expression="Format(\"{0}{1:0,#} {2}\",\"Max Utilization: \", x*100,\"%\")")
txt_2 = Text(txt)
col_2 = Colour(col)
toggle = BooleanToggle(True)
launchxpwin = LaunchTransparentWindow(Show=toggle, Name="Legend", Width=370, Height=500, ChildStatus=0, EnableHorizScroll=False)
textbox = CreateTextBox(DefaultText=txt_2, UpdateButton=False, showLabel=True)
label = CreateLabel(LabelText=expression, LabelSize=12, Justification=0)
c_script = CSharpScript(x=col_2)  # -> A; inputs x: list of Color
# ---------- c_script: C# usings ----------
using System.Drawing;
# ---------- c_script: C# ----------
    List<Color> out_colors = new List<Color>();
    foreach(Color colorL in x){
      Color out_color = colorL.GetBrightness() > 0.4 ? Color.Black : Color.White;
      out_colors.Add(out_color);
    }
    A = out_colors;
# ---------- end c_script ----------
panel_4 = Panel("25,100")
addelems = AddElements(Window=launchxpwin, Elements=flatten([textbox, label]), DoVLChecking=True)  # -> AddedElements, ElementNames
winprops = SetWindowProperties(Window=launchxpwin, ShowTitleBar=toggle, ScaleFactor=1)
adjustelem = AdjustElementAppearance(ElementsToAdjust=textbox, Foreground=c_script, Background=col_2)

medges = MeshEdges(Mesh=mesh)  # -> NakedEdges, InteriorEdges, NonManifoldEdges
list = ValueList({"Utilization", "Critical Check"}, selected="Utilization")
crv = Curve([medges.NakedEdges, medges.InteriorEdges, medges.NonManifoldEdges])
numericresults = ViewNumericResults(
    TimberFrames=data,
    ValueType=list,
    TextColour=ColourSwatch(SwatchColor=RGB(82, 82, 82)),
    TextSize=Slider(0.1, range=0..1))  # -> Info, Points
preview = CustomPreview(Geometry=crv, Material=ColourSwatch(SwatchColor=RGB(171, 171, 171)))
tag = TextTag(Location=numericresults.Points, Text=numericresults.Info)
