# Grasshopper definition Zollinger-Beaver-not parametric.gh (Grasshopper 1.0.7)
# plug-ins: Karamba3D, LunchBox, Beaver, Human UI, treesloth01

crv = Curve([<curve referenced from the Rhino model> x867])

# ----
# SELECT A BEAVER MATERIAL
path = FilePath("C:\Users\rprandini\source\repos\Beaver\Examples\BeaverMaterials.csv")
nickname = Comp_ImportCSVMaterials(FilePath=path)
panel = Panel(nickname)
item = ListItem(List=nickname, Index=Slider(27, range=0..40), Wrap=True)  # -> flatten(Item)

matselect = MaterialSelectionKaramba3D(menu=[dropdown(5), dropdown(2)])
layer_ref = LayerReference(ReferenceToggle=Toggle(True), LayerName="Spans")  # -> Geometry, Name, UserStrings, GUID
mesh = Mesh(flatten(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))

# ----
# CONVERT IT INTO
# A KARAMBA MATERIAL
b2kmat = BeaverToKarambaMaterial(BeaverMaterial=item)

crv_2 = Curve([<curve referenced from the Rhino model> x150])
medges = MeshEdges(Mesh=mesh)  # -> NakedEdges, InteriorEdges, NonManifoldEdges
crv_3 = Curve([<curve referenced from the Rhino model> x176])
crv_4 = Curve([<curve referenced from the Rhino model> x2])
crv_5 = Curve([crv_2, crv_3])
crv_6 = Curve(flatten(crv_2))
explode = Explode(Curve=crv_2, Recursive=True)  # -> Segments, Vertices
explode_2 = Explode(Curve=crv_3, Recursive=True)  # -> Segments, Vertices
midpt = CurveMiddle(Curve=explode.Segments)
lng = ListLength(List=crv_6)

# ---- group: REF
crv_7 = Curve(<curve referenced from the Rhino model>)

# ----
panel_2 = Panel("internal")
unweave = Unweave(List=explode_2.Segments, UnweavePattern=[0, 1, 2])  # -> Data0, Data1, Data2

# ---- group: ORIENT AND FLIP CURVES
crv_8 = Curve(<curve referenced from the Rhino model>)  # disabled
crv_9 = Curve(<curve referenced from the Rhino model>)  # disabled
crv_10 = Curve([<curve referenced from the Rhino model> x867])  # disabled
number_slider = Slider(0.5, range=0..1)  # disabled
number_slider_2 = Slider(0.5, range=0..1)  # disabled
eval = EvaluateCurve(Curve=crv_10, Parameter=number_slider_2)  # -> Point, Tangent, Angle; disabled
eval_2 = EvaluateCurve(Curve=crv_8, Parameter=number_slider)  # -> Point, Tangent, Angle; disabled
xy = XYPlane(Origin=Point(0, 0, 0))  # disabled
angle = Angle(VectorA=eval.Tangent, VectorB=eval_2.Tangent, Plane=xy)  # -> Angle, Reflex; disabled
deg = Degrees(Radians=angle.Angle)  # disabled
c_script = CSharpScript(x=deg)  # -> A; inputs x: Double; disabled
# ---------- c_script: C# ----------
    if(x > 175 & x < 185){A = Math.Abs(180 - x);}
    else{A = x;}
# ---------- end c_script ----------
panel_3 = Panel("5")  # disabled
smaller = SmallerThan(FirstNumber=c_script, SecondNumber=panel_3)  # -> SmallerThan, OrEqualTo; disabled
rad = Radians(Degrees=panel_3)  # disabled
dispatch = Dispatch(List=crv_10, DispatchPattern=smaller.SmallerThan)  # -> ListA, ListB; disabled
join = JoinCurves(Curves=dispatch.ListA, Preserve=False)  # disabled
join_2 = JoinCurves(Curves=dispatch.ListB, Preserve=False)  # disabled
panel_4 = Panel("0.5")  # disabled
eval_3 = EvaluateCurve(Curve=join, Parameter=panel_4)  # -> Point, Tangent, Angle; disabled
vdis = VectorDisplay(Anchor=eval_3.Point, Vector=expr("x*0.2", eval_3.Tangent))  # disabled

# ----
unweave_2 = Unweave(List=explode.Segments, UnweavePattern=[0, 1, 2])  # -> Data0, Data1, Data2
surface = Surface(<surface referenced from the Rhino model>)
srf_cp = SurfaceClosestPoint(Point=midpt, Surface=surface)  # -> Point, UVPoint, Distance
len = Length(Curve=crv_6)  # -> flatten(Length)
repeat = RepeatData(Data=crv_7, Length=lng)
crv_11 = Curve([unweave_2.Data2, unweave.Data2])
evalsrf = EvaluateSurface(Surface=surface, Point=srf_cp.UVPoint)  # -> Point, Normal, UDirection, VDirection, Frame
cross_section = CrossSectionKaramba3D(
    FamilyNameOfCrossSection="DefaultCroSec",
    Material=b2kmat,
    Height_cm="10",
    UpperFlangeWidth_cm="4.8",
    LowerFlangeWidth_cm="4.8",
    mode="Trapezoid")  # -> graft(CrossSection)
vec = Vector(evalsrf.Normal)
unweave_3 = Unweave(List=vec, UnweavePattern=[0, 1, 2])  # -> Data0, Data1, Data2
linetobeam = LineToBeamKaramba3D(
    Line=flatten([unweave_2.Data0, unweave.Data0]),
    Identifier="START",
    CrossSection=cross_section,
    New=True,
    Remove=True,
    LimitDistance_m=0.005,
    ZOrientation=unweave_3.Data0,
    Bending=True,
    SetBucklingLength=True,
    ToPolylineMaxAngle=0.03,
    ToPolylineTolerance=0.01,
    ToPolylineMinEdgeLength=0.25)  # -> Element, Points, Info
# ADD BEAVER
# PARAMETERS
# TO ELEMENTS
linetobeam_2 = LineToBeamKaramba3D(
    Line=flatten(crv_4),
    Identifier="EDGE",
    CrossSection=cross_section,
    New=True,
    Remove=True,
    LimitDistance_m=0.005,
    Bending=True,
    SetBucklingLength=True,
    ToPolylineMaxAngle=0.03,
    ToPolylineTolerance=0.01,
    ToPolylineMinEdgeLength=0.25)  # -> Element, Points, Info
linetobeam_3 = LineToBeamKaramba3D(
    Line=flatten([unweave_2.Data1, unweave.Data1]),
    Identifier="MIDDLE",
    CrossSection=cross_section,
    New=True,
    Remove=True,
    LimitDistance_m=0.005,
    ZOrientation=unweave_3.Data1,
    Bending=True,
    SetBucklingLength=True,
    ToPolylineMaxAngle=0.03,
    ToPolylineTolerance=0.01,
    ToPolylineMinEdgeLength=0.25)  # -> Element, Points, Info
linetobeam_4 = LineToBeamKaramba3D(
    Line=flatten([unweave_2.Data2, unweave.Data2]),
    Identifier="END",
    CrossSection=cross_section,
    New=True,
    Remove=True,
    LimitDistance_m=0.005,
    ZOrientation=unweave_3.Data2,
    Bending=True,
    SetBucklingLength=True,
    ToPolylineMaxAngle=0.03,
    ToPolylineTolerance=0.01,
    ToPolylineMinEdgeLength=0.25)  # -> Element, Points, Info
Z = UnitZ(Factor="-1.5")
disassemble = DisassembleElementKaramba3D(Element=linetobeam.Element)  # -> Element, ElementIdentifier, AxisOfElement, CrossSection, Joint, Material, LocalCoordinateSystem, ElementIsActive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
beam_joints = BeamJointsKaramba3D(
    AtElementIdentifiers="START",
    CtKNMAtStartingNode=Vector(0, 0, 0),
    CrKNmRadAtStartingNode=Vector(0, 0, 0),
    CtKNMAtEndNode=Vector(0, 0, 0),
    CrKNmRadAtEndNode=Vector(0, 0, 0),
    menu=[buttons(off, off, off, on, on, on), buttons(off, off, off, off, off, off)])
beam_joints_2 = BeamJointsKaramba3D(
    AtElementIdentifiers="END",
    CtKNMAtStartingNode=Vector(0, 0, 0),
    CrKNmRadAtStartingNode=Vector(0, 0, 0),
    CtKNMAtEndNode=Vector(0, 0, 0),
    CrKNmRadAtEndNode=Vector(0, 0, 0),
    menu=[buttons(off, off, off, off, off, off), buttons(off, off, off, on, on, on)])  # disabled
beam_loads = BeamLoadsKaramba3D(LoadCase="P", ForceVector=Z, TStart=0, TEnd=1, mode="Block", menu=[buttons(off, off, on)])
crv_12 = Curve(disassemble.AxisOfElement)
panel_5 = Panel("0.001")  # disabled
pt = Point([<point referenced from the Rhino model> x32])  # disabled
lng_2 = ListLength()  # disabled
lng_3 = ListLength()  # disabled
addition = Addition(A=lng_3, B=lng_2)  # disabled
supp = SupportKaramba3D(PosInd=pt, menu=[buttons(on, on, on, off, off, off)])  # disabled
# RUN
# KARAMBA ANALYSIS
assemble = AssembleModelKaramba3D(
    Elem=[linetobeam.Element, linetobeam_3.Element, linetobeam_4.Element, linetobeam_2.Element],
    Support=supp,
    Load=beam_loads,
    Joint=[beam_joints, beam_joints_2],
    LimitDistance_m=panel_5)  # -> Model, Info, Mass_kg, CenterOfGravity, LoadCaseNames; disabled
analyze = AnalyzeKaramba3D(Model=assemble.Model)  # -> CalculatedModel, MaximumDisplacement_cm, ResultingForceOfGravity_kN, ElasticEnergyChange_kNm; disabled
series = Series(Start=0, Step=1, Count=addition)  # disabled
modelview = ModelViewKaramba3D(Model=analyze.CalculatedModel, ResultFactors=1, ResultCase=-1)  # -> Model, DeformedMesh, DeformedAxes, DeformedModel; disabled
panel_6 = Panel("""P
QA
W""")  # disabled
toggle = BooleanToggle(False)  # disabled

# ----
# BEAVER
# IMPORT TO BEAVER
panel_7 = Panel("P")  # disabled
panel_8 = Panel("2")  # disabled
k2b = KarambaToBeaver(
    KarambaModel=analyze.CalculatedModel,
    BeamIdentifiers=series,
    NumberOfResultsPerBeamElement=panel_8,
    LoadCaseType=panel_7,
    Run=toggle)  # disabled

# ----
# DISPLAY KARAMBA RESULTS
beamview = BeamViewKaramba3D(Model=modelview.Model)  # -> Model, MeshesOfRenderedBeams, DeformedBeamAxes, LegendColors, LegendTags; disabled
type = ValueList({"All", "SLS", "AllULS", "Tension", "Compression", "BiaxialBending", "Shear", "Torsion", "TensionAndBending", "CompressionAndBending", "CompressionAndBendingColumn", "CompressionAndBendingBeam", "TorsionAndShear"}, selected="Shear")  # disabled
legend = Legend(
    Colour=beamview.LegendColors,
    Tags=beamview.LegendTags,
    Rectangle={Plane=PlaneXY(-10.2767964, 8.52262475, 0), Size=Domain2(u=-1.919640395..1.919640395, v=-5.028908498..5.028908498)},
    LegendType=1)  # disabled
value_list = ValueList({"All", "Y", "Z"}, selected="All")  # disabled
value_list_2 = ValueList({"All", "Y", "Z"}, selected="All")  # disabled
value_list_3 = ValueList({"All", "Y", "Z"}, selected="All")  # disabled
value_list_4 = ValueList({"All", "Y", "Z"}, selected="All")  # disabled
value_list_5 = ValueList({"All": -1, "G": 0, "1.35G": 1}, selected="All")  # disabled
value_list_6 = ValueList({"All": -1, "G": 0, "1.35G": 1}, selected="All")  # disabled
value_list_7 = ValueList({"All": -1, "G": 0, "1.35G": 1}, selected="All")  # disabled
value_list_8 = ValueList({"All": -1, "G": 0, "1.35G": 1}, selected="All")  # disabled
nickname_2 = TimberFrameView(TimberFrames=k2b, UtilizationType=type)  # -> TimberFrames, Mesh, LegendT, LegendC, MaximumUtilization
criticalcheck = VisualizeCriticalCheck(TimberFrames=k2b)  # -> TimberFrames, Mesh, LegendT, LegendC
Z_2 = UnitZ(Factor=Slider(0, range=0..6))
data = Data(nickname_2.TimberFrames)
mesh_2 = Mesh(nickname_2.Mesh)
txt = Text(nickname_2.LegendT)
col = Colour(nickname_2.LegendC)
move = Move(Geometry=mesh_2, Motion=Z_2)  # -> Geometry, Transform
list = ValueList({"Utilization", "Critical Check"}, selected="Utilization")
numericresults = ViewNumericResults(
    TimberFrames=data,
    ValueType=list,
    TextColour=ColourSwatch(SwatchColor=RGB(82, 82, 82)),
    TextSize=Slider(0.064, range=0..1))  # -> Info, Points, Report
medges_2 = MeshEdges(Mesh=move.Geometry)  # -> NakedEdges, InteriorEdges, NonManifoldEdges
crv_13 = Curve([medges_2.NakedEdges, medges_2.InteriorEdges, medges_2.NonManifoldEdges])
tag = TextTag(Location=numericresults.Points, Text=numericresults.Info)
preview = CustomPreview(Geometry=crv_13, Material=ColourSwatch(SwatchColor=RGB(171, 171, 171)))

# ----
# LEGEND
expression = Expression(x=nickname_2.MaximumUtilization, Expression="Format(\"{0}{1:0,#} {2}\",\"Max Utilization: \", x*100,\"%\")")
txt_2 = Text(txt)
col_2 = Colour(col)
launchxpwin = LaunchTransparentWindow(Show=Toggle(True), Name="Legend", Width=370, Height=500, ChildStatus=0, EnableHorizScroll=False)
textbox = CreateTextBox(DefaultText=txt_2, UpdateButton=False, showLabel=True)
label = CreateLabel(LabelText=expression, LabelSize=12, Justification=0)
c_script_2 = CSharpScript(x=col_2)  # -> A; inputs x: list of Color
# ---------- c_script_2: C# usings ----------
using System.Drawing;
# ---------- c_script_2: C# ----------
    List<Color> out_colors = new List<Color>();
    foreach(Color colorL in x){
      Color out_color = colorL.GetBrightness() > 0.4 ? Color.Black : Color.White;
      out_colors.Add(out_color);
    }
    A = out_colors;
# ---------- end c_script_2 ----------
panel_9 = Panel("25,100")
addelems = AddElements(Window=launchxpwin, Elements=flatten([textbox, label]), DoVLChecking=True)  # -> AddedElements, ElementNames
winprops = SetWindowProperties(Window=launchxpwin, ShowTitleBar=Toggle(True), ScaleFactor=Slider(0.7, range=0..1))
adjustelem = AdjustElementAppearance(ElementsToAdjust=textbox, Foreground=c_script_2, Background=col_2, FontSize=Slider(18, range=0..100))
