# Grasshopper definition Zollinger-Beaver.gh (Grasshopper 1.0.7)
# plug-ins: NGon, Karamba3D, Beaver, LunchBox, Human UI, Kangaroo2 Components, Pufferfish

# ---- group: Clean Mesh
# Tiling Method
brep = Brep(<brep referenced from the Rhino model>)
diamonddivide = DiamondDivide(
    Surface=brep,
    U=Slider(20, range=0..80),
    V=Slider(30, range=0..60),
    Boundary=Slider(0, range=-1..1),
    Swap=invert(True),
    Flip=True,
    Divisions=False,
    Explode=True)
corners = Corners(Mesh=diamonddivide, Angle=135)  # -> Corners, ID
simplify = Simplify(Mesh=diamonddivide, Fixed=corners.Corners)
weld = WeldMesh(Mesh=simplify, Radius=0.1, Align=False, Use_RTree=True)
top = GetPolylines(Mesh=flatten(weld))  # -> flatten(Polylines)
fromp = FromPolylines(Curves=top, Min_Triangulation=True)
unify = UnifyWindings(Mesh=fromp)
mesh = Mesh(unify)

# ----
medges = MeshEdges(Mesh=diamonddivide)  # -> NakedEdges, InteriorEdges, NonManifoldEdges

# ----
# SELECT A BEAVER MATERIAL
path = FilePath("C:\Users\rprandini\source\repos\Beaver\Examples\BeaverMaterials.csv")
nickname = Comp_ImportCSVMaterials(FilePath=path)
panel = Panel(nickname)
item = ListItem(List=nickname, Index=Slider(27, range=0..40), Wrap=True)  # -> flatten(Item)

# ---- group: Tiling
crv = Curve(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)
cluster = Cluster(C=crv)
c_script = CSharpScript(T0=crv, r="0.02", Reference="C:\USERS\RPRANDINI\DESKTOP\RENAN\SOFTWARE\GRASSHOPPER\3.1.0\NGonsCore.dll")  # -> out, Tiles2D, A, B; inputs T0: Polyline, r: Double
# ---------- c_script: C# usings ----------
using NGonsCore;
# ---------- c_script: C# ----------
    Component.Message = "Create Tile \n 1 Quad \n 4 Half-tri \n 4 Quarter-tri";


    var lines = QuadTile0(T0, r);

    List<NGonsCore.Tile2D> tiles = new List<NGonsCore.Tile2D>();

    //4 edge tile
    DataTree<Polyline> dt = new DataTree<Polyline>();
    dt.AddRange(lines, new GH_Path(0, 0));
    List < Polyline>[] crvs_ = new List<Polyline>[]{new List<Polyline>(){lines[0]},new List<Polyline>(){lines[1]},new List<Polyline>(){lines[2]},new List<Polyline>(){lines[3]}};
    NGonsCore.Tile2D tile2D = new NGonsCore.Tile2D(0,T0, crvs_, new int[]{0,1,2,3}, new int[]{0,1,2,3}, new int[]{0,0}, new int[]{1,3});
    tiles.Add(tile2D);


    //2 edge tiles
    for(int i = 0; i < 4; i++){

      int id0 = i;
      int id1 = (i + 1) % 4;
      int id2 = (i + 2) % 4;


      Point3d p0 = T0[id0];
      Point3d p1 = T0[id1];
      Point3d p2 = T0[id2];

      int id2In = (id1 % 2 == 0) ? -1 : -1;

      Polyline pline = new Polyline(new Point3d[]{p0,p1,p2,p0});

      List<Polyline>[] crvs = new List<Polyline>[]{new List<Polyline>(),new List<Polyline>(),new List<Polyline>()};
      int[] ids = new int[]{id0,id1,id2In};

      //Trim polylines and assign id
      foreach(Polyline l in lines){

        int id = -1;
        Curve c = IntersectClosedOpenCurve(pline.ToNurbsCurve(), l.ToNurbsCurve(), ref id, new int[]{0,1});

        if(c != null && id != -1){
          Print(id.ToString());
          Polyline trimedPolyline;
          c.TryGetPolyline(out trimedPolyline);
          crvs[id].Add(trimedPolyline);
        }
      }

      //display
      for(int j = 0; j < crvs.Length; j++){
        dt.AddRange(crvs[j], new GH_Path(i + 1, j));
        dt.Add(pline, new GH_Path(i + 1, j));
      }


      NGonsCore.Tile2D tile2DHalf = new NGonsCore.Tile2D(i+1,pline, crvs, ids, ids, new int[]{id0}, new int[]{id1});
      //Rhino.RhinoApp.WriteLine(id0.ToString() + " " + id1.ToString());
      //NGonsCore.Tile2D tile2DHalf = new NGonsCore.Tile2D(pline, crvs, ids, ids, new int[]{0}, new int[]{1});
      tiles.Add(tile2DHalf);

    }

    //1 edge tiles

    for(int i = 0; i < 4; i++){



      int id0 = i;
      int id1 = (i + 1) % 4;
      //int id2 = (i + 2) % 4;


      Point3d p0 = T0[id0];
      Point3d p1 = T0[id1];
      Point3d p2 = Point3d.Origin;



      Polyline pline = new Polyline(new Point3d[]{p0,p1,p2,p0});

      List<Polyline>[] crvs = new List<Polyline>[]{new List<Polyline>(),new List<Polyline>(),new List<Polyline>()};
      int id1In = (id1 % 2 == 0) ? -1 : -1;
      int id2In = (id1 % 2 == 0) ? -1 : -1;
      int[] ids = new int[]{id0,id1In,id2In};

      //Trim polylines and assign id
      foreach(Polyline l in lines){

        int id = -1;
        Curve c = IntersectClosedOpenCurve(pline.ToNurbsCurve(), l.ToNurbsCurve(), ref id, new int[]{0});

        if(c != null && id != -1){
          Print(id.ToString());
          Polyline trimedPolyline;
          c.TryGetPolyline(out trimedPolyline);
          crvs[id].Add(trimedPolyline);
        }
      }

      NGonsCore.Tile2D tile2DQuarter = new NGonsCore.Tile2D(i+4,pline, crvs, ids, ids, new int[0], new int[0]);
      tiles.Add(tile2DQuarter);

      //display
      for(int j = 0; j < crvs.Length; j++){
        dt.AddRange(crvs[j], new GH_Path(4 + i + 1, j));
        dt.Add(pline, new GH_Path(4 + i + 1, j));
      }
    }





    A = tiles;
    B = dt;
    Tiles2D = new GH_ObjectWrapper(tiles);
    //Display
# ---------- c_script: C# additional code ----------
  public Curve IntersectClosedOpenCurve(Curve c0, Curve c1, ref int id, int[] prioritySegments){

    Rhino.Geometry.Intersect.CurveIntersections ci = Rhino.Geometry.Intersect.Intersection.CurveCurve(c0, c1, 0.1, 0.1);

    Curve crv = null;
    id = -1;
    switch(ci.Count){

      case(2):
        //        Rhino.RhinoApp.WriteLine();
        //        Rhino.RhinoApp.WriteLine("Two Points");

        double t0 = ci[0].ParameterB;
        double t1 = ci[1].ParameterB;
        if( ((t0 == 0) && (t1 == 1)) || ((t0 == 1) && (t1 == 0))){
          crv = c1;

        }else{
          crv = t0 < t1 ? c1.Trim(t0, t1) : c1.Trim(t1, t0);
        }

        //Rhino.RhinoApp.WriteLine(t0.ToString() + " " + t1.ToString());
        //find closest id
        Polyline polyline;
        c0.TryGetPolyline(out polyline);
        polyline.RemoveAt(polyline.Count - 1);

        //priority segments
        int nakedID = -1;
        int clothedID = -1;
        foreach(var cii in ci){
          nakedID = (int) Math.Floor(cii.ParameterA);

          if( Array.IndexOf(prioritySegments, nakedID) != -1 ){
            clothedID = nakedID;
            break;
          }
        }

        id = (clothedID != -1) ? clothedID : nakedID;

        //Rhino.RhinoDoc.ActiveDoc.Objects.AddCurve(crv  );
        //Rhino.RhinoApp.WriteLine("id" + id.ToString());

        break;
      case(1):
        //Rhino.RhinoApp.WriteLine();
        //Rhino.RhinoApp.WriteLine("One Points");

        PointContainment pc0 = c0.Contains(c1.PointAtStart, Plane.WorldXY, 0.01);
        PointContainment pc1 = c0.Contains(c1.PointAtEnd, Plane.WorldXY, 0.01);
        // Rhino.RhinoApp.WriteLine(pc0.ToString() + " " + pc1.ToString());

        if(pc0 == PointContainment.Inside  ){
          //Rhino.RhinoDoc.ActiveDoc.Objects.AddCurve(c1);
          crv = ci[0].ParameterB == 0 ? c1.Trim(ci[0].ParameterB, c1.Domain.T1) : c1.Trim(0.0, ci[0].ParameterB);
          //Rhino.RhinoApp.WriteLine("0.0 " +  ci[0].ParameterB.ToString());
          //Rhino.RhinoDoc.ActiveDoc.Objects.AddCurve(crv);
          id = (int) Math.Floor(ci[0].ParameterA);
        } else if(pc1 == PointContainment.Inside ){
          crv = c1.Trim(ci[0].ParameterB, c1.Domain.T1);
          crv = ci[0].ParameterB == c1.Domain.T1 ? c1.Trim(c1.Domain.T1, ci[0].ParameterB) : c1.Trim(ci[0].ParameterB, c1.Domain.T1);
          //Rhino.RhinoDoc.ActiveDoc.Objects.AddCurve(crv);
          id = (int) Math.Floor(ci[0].ParameterA);
        }

        break;
    }

    return crv;

  }

  public List<Polyline> QuadTile0  (Polyline T0, double r){

    //Create lines
    double t0 = -r;
    var pt0 = T0.PointAt(0.5 - t0);
    var pt1 = T0.PointAt(1.5 + t0);
    var pt2 = T0.PointAt(2.5 - t0);
    var pt3 = T0.PointAt(3.5 + t0);

    Point3d c = T0.CenterPoint();
    Line l = new Line(pt0, pt2);

    Line l0 = new Line(pt0, c);
    Line l1 = new Line(pt1, l.ClosestPoint(pt1, false));
    l1.Transform(Transform.Scale(l1.From, 0.98));
    Line l2 = new Line(c, pt2);
    Line l3 = new Line(l.ClosestPoint(pt3, false), pt3);
    l3.Transform(Transform.Scale(l3.To, 0.98));


    List<Polyline> lines = new List<Polyline>(){
        l0.ToPolyline(),
        l1.ToPolyline(),
        l2.ToPolyline(),
        l3.ToPolyline(),

        };

    return lines;
  }

  public List<Polyline> QuadTile1  (Polyline T0, double r){

    //Create lines
    double t0 = -r;
    var pt0 = T0.PointAt(1);
    var pt1 = T0.PointAt(2.0 + t0);
    var pt2 = T0.PointAt(3);
    var pt3 = T0.PointAt(4.0 + t0);

    Point3d c = T0.CenterPoint();
    Line l = new Line(pt1, pt3);

    Line l0 = new Line(pt1, c);
    Line l1 = new Line(pt0, l.ClosestPoint(pt0, false));
    l1.Transform(Transform.Scale(l1.From, 0.999));
    Line l2 = new Line(c, pt3);
    Line l3 = new Line(l.ClosestPoint(pt2, false), pt2);
    l3.Transform(Transform.Scale(l3.To, 0.999));


    List<Polyline> lines = new List<Polyline>(){
        l0.ToPolyline(),
        l1.ToPolyline(),
        l2.ToPolyline(),
        l3.ToPolyline(),





        };

    return lines;
  }
# ---------- end c_script ----------

# ----
matselect = MaterialSelectionKaramba3D(menu=[dropdown(5), dropdown(2)])
layer_ref = LayerReference(ReferenceToggle=Toggle(True), LayerName="Spans")  # -> Geometry, Name, UserStrings, GUID
radius1 = Slider(50, range=0..100)

# ---- group: Tiling
bfs = BFS(Mesh=mesh, Start="0", Angle=0.14)  # -> Vertices, simplify(Edges), EdgeVec, Bad, Mesh, FaceVec
c_script_2 = CSharpScript(
    M=mesh,
    E=bfs.Edges,
    Tiles2D=c_script.Tiles2D,
    Reference="C:\USERS\RPRANDINI\DESKTOP\RENAN\SOFTWARE\GRASSHOPPER\3.1.0\NGonsCore.dll")  # -> out, Tiles2DMapped, lines, A; inputs M: Mesh, E: tree of Int32
# ---------- c_script_2: C# usings ----------
using NGonsCore;
using System.Linq;
# ---------- c_script_2: C# ----------
    Component.Message = "Run Tiling";
    try{
      //////////////////////////////////////////////////////////////
      //Inputs
      //////////////////////////////////////////////////////////////
      List<Tile2D> td = (List<Tile2D>) (Tiles2D);
      Tile2D[] tiles = new Tile2D[M.Ngons.Count];

      HashSet<int> h = new HashSet<int>();
      Polyline[] plines = M._Polylines();
      Plane[] planes = M._FPlanes();

      tDisplay = new Rhino.Display.Text3d[M.Ngons.Count][];
      bbox = M.GetBoundingBox(false);


      //////////////////////////////////////////////////////////////
      //Iterate bfs
      //////////////////////////////////////////////////////////////

      //1. Find First Tile
      int f = E.Branch(0)[0];
      tiles[f] = GetTile(td, plines[f].Count - 1);

      tiles[f].Map(plines[f]);
      GetDisplay(f, plines[f], planes[f], tiles[f]);

      //2. Find the rest of tile orientation

      int[] e = new int[]{0,1,2,3};
      int[] n = new int[]{3,2,1,0};

      //Rhino.RhinoApp.ClearCommandHistoryWindow();
      for(int i = 0; i < E.BranchCount; i++){//E.BranchCount
        //Rhino.RhinoApp.WriteLine(i.ToString());
        //2.1 Find common edges
        int f0 = E.Branch(i)[0];//Local a and local b
        int f1 = E.Branch(i)[1];
        int[] ce = CommonEdge(M, f0, f1);//common local edges


        //Get last tile mask
        int f0E = tiles[f0].e[ce[0]];
        int neiMask = n[f0E];

        //Get masks fot the next
        int[] fe = M._fe(f1);
        int[] maskIDS = new int[fe.Length];

        for(int j = 0; j < maskIDS.Length; j++){

          int start = ce[1];
          int eID = NGonsCore.MathUtil.Wrap((start + f0E - j), 4);
          int nextID = n[eID];

          //Indetify naked edges, this part is wrong
          if(maskIDS.Length == 3){
            if(M.TopologyEdges.GetConnectedFaces(fe[j]).Length == 1)
              nextID = -1;
          }


          //not clean
          if(maskIDS[0] != -1){
            if(j == maskIDS.Length - 1 && nextID != -1){
              nextID = NGonsCore.MathUtil.Wrap(maskIDS[0] - 1, 4);
            }
          }

          maskIDS[j] = nextID;
          // Rhino.RhinoApp.WriteLine(nextID.ToString());
        }

        //Rhino.RhinoApp.WriteLine();

        //2.2 Get not mapped tile

        tiles[f1] = GetTile(td, plines[f1].Count - 1, maskIDS);

        if(tiles[f1] == null){
          Rhino.RhinoApp.WriteLine(" " + (plines[f1].Count - 1).ToString()
            + " " + maskIDS[0].ToString()
            + " " + maskIDS[1].ToString()
            + " " + maskIDS[2].ToString()
            + " faces " + f0.ToString()
            + " " + f1.ToString()

            );
          break;

        }


        //Local Edge id

        //Rhino.RhinoApp.WriteLine(i.ToString() + " " + f1.ToString());
        //Rhino.RhinoApp.WriteLine(tiles[f1].ToString());
        int f1E = tiles[f1].e[ce[1]];



        //2.3 Rotate tiles until criteria is met

        int shiftTimes = 0;
        for(int j = 0; j < 5; j++){

          if(n[f0E] == f1E)
            break;
          tiles[f1].Shift();
          tiles[f1].ShiftPolylines();
          f1E = tiles[f1].e[ce[1]];
          shiftTimes++;
        }



        tiles[f1].shiftTimes = shiftTimes;


        //2.4 Map tile to mesh face polyline
        tiles[f1].Map(plines[f1]);
        GetDisplay(f1, plines[f1], planes[f1], tiles[f1]);
      }

      ////////////////////////////////////////////////////////////
      //Checker pattern
      ////////////////////////////////////////////////////////////
      bool[] checker = NGonsCore.Graphs.UndirectedGraphBfsRhino.Checker(M);

      for(int i = 0; i < tiles.Length; i++){

        tiles[i].eFlag = new bool[tiles[i].e.Length];

        for(int j = 0; j < tiles[i].e.Length; j++){
          tiles[i].eFlag[j] = Math.Abs(tiles[i].e[j]) % 2 == Convert.ToInt32(checker[i]) ? true : false;
        }

      }

      _tmap = GetTileOutlines(tiles);
      lines_ = _tmap;
      Tiles2DMapped_ = new GH_ObjectWrapper(tiles);
      A = checker;
    }catch(Exception e){
      Rhino.RhinoApp.WriteLine(e.ToString());
    }
# ---------- c_script_2: C# additional code ----------
  BoundingBox bbox;
  public Rhino.Display.Text3d[][] tDisplay;
  public DataTree<Polyline> _tmap;

  public Tile2D GetTile(List<Tile2D> td, int sides, int[] maskIDS = null){
    //Rhino.RhinoApp.WriteLine(" ");
    for(int i = 0; i < td.Count; i++){

      //if sidecount is the same
      if(td[i].e.Length == sides){

        Tile2D tileTemp = td[i].Duplicate();


        //Rhino.RhinoApp.WriteLine((maskIDS != null).ToString());
        if(maskIDS != null){



          bool flag = true;
          //Rhino.RhinoApp.WriteLine();

          int[] tdECopy = new int[td[i].e.Length];
          Array.Copy(td[i].e, tdECopy, td[i].e.Length);
          foreach(int maskID in maskIDS){
            //Rhino.RhinoApp.WriteLine(maskID.ToString());
            int isInTile = Array.IndexOf(tdECopy, maskID);
            if( isInTile == -1){
              flag = false;
              break;
            }else{
              tdECopy[isInTile] = -9;
            }
          }

          //Rhino.RhinoApp.WriteLine(flag.ToString());

          if(!flag){
            continue;
          }
        }

        // Rhino.RhinoApp.WriteLine();

        //Rhino.RhinoApp.WriteLine("_______________");
        //        if(tileTemp.adj0.Length != 0){
        //          Print("TileID " + i.ToString() + " _______ " + tileTemp.adj0[0] + " " + tileTemp.adj1[0]);
        //        }else{
        //          Print("TileID " + i.ToString());
        //        }
        return tileTemp;

      }
    }
    Rhino.RhinoApp.WriteLine("Returned Null Tile");
    return null;
  }


  public void GetDisplay(int f, Polyline pline, Plane plane, Tile2D t){
    Polyline scalePline = pline.Duplicate();
    scalePline.Transform(Transform.Scale(plane.Origin, 0.75));
    Rhino.Display.Text3d[] txt = new Rhino.Display.Text3d[pline.SegmentCount];

    for(int i = 0; i < pline.SegmentCount; i++){
      Plane textPlane = new Plane(plane);
      textPlane.Origin = scalePline.PointAt(i + 0.5);

      Rhino.Display.Text3d entity = new Rhino.Display.Text3d(t.e[i].ToString(), textPlane, 200);

      txt[i] = entity;
    }

    tDisplay[f] = txt;

  }

  public  int[] CommonEdge(Mesh M, int F0, int F1) {

    int[] e0 = M._fe(F0);
    int[] e1 = M._fe(F1);


    var common = e0.Intersect(e1);

    if (common.Count() > 0){

      int commonEdge = common.First();

      int a = 0;
      int b = 0;

      for(int i = 0; i < e0.Length; i++){
        if(commonEdge == e0[i]){
          a = i;
          break;
        }
      }

      for(int i = 0; i < e1.Length; i++){
        if(commonEdge == e1[i]){
          b = i;
          break;
        }
      }

      return new int[]{a,b};


    }else
      return new int[]{-1,-1};
  }





  //Output methods
  public DataTree<Polyline> GetTileOutlines(Tile2D[] tm){
    DataTree<Polyline> dt = new  DataTree<Polyline>();
    for(int i = 0; i < tm.Length; i++){
      if(tm[i] != null){
        for(int j = 0; j < tm[i].geo.Length; j++){
          dt.AddRange(tm[i].geo[j], new GH_Path(i, j));
        }
      }
    }
    return dt;
  }

  //Return a BoundingBox that contains all the geometry you are about to draw.
  public override BoundingBox ClippingBox
  {
    get
    {
      return bbox;
    }
  }

  //Draw all meshes in this method.
  public override void DrawViewportMeshes(IGH_PreviewArgs args)
  {
  }

  //Draw all wires and points in this method.
  public override void DrawViewportWires(IGH_PreviewArgs args)
  {

    foreach(var l in this._tmap.AllData()){
      args.Display.DrawArrow(new Line(l[0], l[l.Count - 1]), System.Drawing.Color.Black);
    }


    foreach(var array in tDisplay){
      if(array != null){
        foreach(var element in array){
          args.Display.Draw3dText(element, System.Drawing.Color.Black);
        }
      }
    }

  }
# ---------- end c_script_2 ----------
c_script_3 = CSharpScript(
    M=mesh,
    Tiles2DMapped=c_script_2.Tiles2DMapped,
    Tolerance=Slider(0.03, range=0..0.11),
    Radius0=Slider(15, range=0..100),
    Radius1=radius1,
    Reference="C:\USERS\RPRANDINI\DESKTOP\RENAN\SOFTWARE\GRASSHOPPER\3.1.0\NGonsCore.dll")  # -> out, tiles, ccDt, ccDtPlines, ccDtLines, ccDtZAxis, ccDtDir, pipes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; inputs M: Mesh, Tolerance: Double, Radius0: Double, Radius1: Double
# ---------- c_script_3: C# ----------
    try{
      Component.Message = "Connected Components \n F   e[j]   j";

      //////////////////////////////////////////////////////////////
      //Inputs
      //////////////////////////////////////////////////////////////

      Tile2D[] tiles = (Tile2D[]) (Tiles2DMapped);

      Polyline[] plines = M._Polylines();
      Plane[] planes = M._FPlanes();

      tDisplay = new Rhino.Display.Text3d[M.Ngons.Count][];
      tDisplayEdges = new Rhino.Display.Text3d[M.Ngons.Count][];
      bbox = M.GetBoundingBox(false);

      int eCount = 0;
      Dictionary<int,int> eCountF = new Dictionary<int,int>();
      Dictionary<int,int[]> v_FE = new Dictionary<int,int[]>();
      for(int i = 0; i < M.Ngons.Count; i++){
        eCountF.Add(i, eCount);
        GetDisplay(i, plines[i], planes[i], tiles[i], eCount);
        for(int j = 0; j < tiles[i].e.Length; j++){
          v_FE.Add(eCount + j, new int[]{i,j});
        }
        eCount += tiles[i].e.Length;


      }
      tiles_ = tiles;


      //////////////////////////////////////////////////////////////
      //A Construct UWG and GetConnectedComponents
      //////////////////////////////////////////////////////////////


      NGonsCore.Graphs.UndirectedWeightedGraph g = new NGonsCore.Graphs.UndirectedWeightedGraph(eCount);

      //////////////////////////////////////////////////////////////
      //A.1 Add Vertices if they have geometry
      //////////////////////////////////////////////////////////////
      for (int i = 0; i < tiles.Length; i++){
        for(int j = 0; j < tiles[i].e.Length; j++){
          if(tiles[i].geo[j].Count != 0){//skip vertices without geometry
            g.InsertVertex(
              i.ToString() + ";"
              + tiles[i].e[j] + ";"
              + j
              );
          }//if
        }//for j
      }//for i

      //////////////////////////////////////////////////////////////
      //A.2 Add Edges per tile to connect two continuous bars
      //////////////////////////////////////////////////////////////
      for (int i = 0; i < tiles.Length; i++){

        if(tiles[i].e.Length == 4){

          List<int> ids = new List<int>();

          for(int j = 0; j < tiles[i].e.Length; j++){
            if( tiles[i].e[j] == 0 || tiles[i].e[j] == 2 ) {
              ids.Add(j);
            }// if
          }//for


          g.InsertEdge(

            string.Format("{0};{1};{2}", i, tiles[i].e[ids[0]], ids[0]),
            string.Format("{0};{1};{2}", i, tiles[i].e[ids[1]], ids[1]),
            1);

        }
      }

      //////////////////////////////////////////////////////////////
      //A.3 Add Edges per neighbour-edge
      //////////////////////////////////////////////////////////////
      int[][] ef = M.GetNgonsConnectedToNGonsEdges(M.GetAllNGonEdges(M.GetNGonsTopoBoundaries()), true);


      for(int i = 0; i < ef.Length; i++){

        //Find common edges - Local a and local b
        int f0 = ef[i][0];
        int f1 = ef[i][1];

        if(f0 != -1 && f1 != -1){

          int[] ce = CommonEdge(M, f0, f1); //common local edges


          if(f0 == 74 || f1 == 74){
            Print(string.Format("{0};{1};{2}", f0, tiles[f0].e[ce[0]], ce[0]) + " " +
              string.Format("{0};{1};{2}", f1, tiles[f1].e[ce[1]], ce[1]));
          }

          g.InsertEdge(
            string.Format("{0};{1};{2}", f0, tiles[f0].e[ce[0]], ce[0]),
            string.Format("{0};{1};{2}", f1, tiles[f1].e[ce[1]], ce[1]),
            1);

        }//if
      }//for


      //Connected componets
      List< NGonsCore.Graphs.UndirectedWeightedGraph> cc = g.ConnectedComponents(g, true);


      //Create DataTree for components and geometry
      var ccDt = new DataTree<string>();
      var ccDtPlines = new DataTree<Polyline>();

      for(int i = 0; i < cc.Count; i++){
        for(int j = 0; j < cc[i].VertexList.Length; j++){

          ccDt.Add(cc[i].VertexList[j].name, new GH_Path(i));

          var txt = cc[i].VertexList[j].name.Split(';');

          int f = Convert.ToInt32(txt[0]);
          int eMask = Convert.ToInt32(txt[1]);
          int e = Convert.ToInt32(txt[2]);

          List<Polyline> tilePlines = tiles[f].geo[e];
          ccDtPlines.AddRange(tilePlines, new GH_Path(i));


        }
      }




      //////////////////////////////////////////////////////////////
      //B Component connectivity
      //////////////////////////////////////////////////////////////

      DataTree<int> adjDt = new DataTree<int>();

      for (int i = 0; i < tiles.Length; i++){

        //Loop through tile adjacency
        for(int j = 0; j < tiles[i].adj0.Length; j++){

          if(tiles[i].e.Length == 3) {
            //Rhino.RhinoApp.WriteLine(tiles[i].adj0[j].ToString() + " " + tiles[i].adj1[j].ToString() + " " + i.ToString());
          }

          int adj0 = tiles[i].adj0[j];
          int adj1 = tiles[i].adj1[j];

          int f = i;
          int e0Mask = adj0;
          int e0 = -1;
          for(int k = 0; k < tiles[i].e.Length; k++){
            if( tiles[i].e[k] == e0Mask ){
              e0 = k;
              break;
            }
          }

          int e1Mask = adj1;
          int e1 = -1;
          for(int k = 0; k < tiles[i].e.Length; k++){
            if( tiles[i].e[k] == e1Mask ){
              e1 = k;
              break;
            }
          }

          //          if(tiles[i].e.Length == 3) {
          //            f = i;
          //            e0Mask = tiles[i].e[adj0];
          //            e0 = adj0;
          //
          //            e1Mask = tiles[i].e[adj1];
          //            e1 = adj1;
          //
          //          }






          string v0 = f.ToString() + ";" + e0Mask.ToString() + ";" + e0.ToString();
          string v1 = f.ToString() + ";" + e1Mask.ToString() + ";" + e1.ToString();

          //if(tiles[i].e.Length == 3) {
          //RhinoApp.WriteLine(string.Format("{0}  ______ {1}  ______  {2}", i, v0, v1));
          //Rhino.RhinoApp.WriteLine();
          //}

          //Iterate over graph and find which component two pairs belongs
          int id0 = -1;
          int id1 = -1;
          int localCounter = 0;


          for(int k = 0; k < cc.Count; k++){
            foreach(NGonsCore.Graphs.Vertex v in cc[k].VertexList){
              if(v.name == v0){
                id0 = k;
                localCounter++;
              }

              if(v.name == v1){
                id1 = k;
                localCounter++;
              }

              if(localCounter == 2){
                break;
              }
            }//foreach

          }


          if(tiles[i].e.Length == 3 && (id0 == -1 || id1 != -1 || id0 == id1)) {




            //Rhino.RhinoApp.WriteLine("Not Found " + v0.ToString() + "         " +v1.ToString());

          }

          //In this case there woudl be duplicates
          if(id0 != -1 && id1 != -1 && id0 != id1){
            //Rhino.RhinoApp.WriteLine("Found");
            adjDt.Add(id0, new GH_Path(id1));
            adjDt.Add(id1, new GH_Path(id0));
          }

        }//for j

      }


      //Remove component if it has no adjacencies

      for(int i = 0; i < cc.Count; i++){
        if(!adjDt.PathExists(new GH_Path(i))){
          adjDt.RemovePath(new GH_Path(i));
          ccDtPlines.RemovePath(new GH_Path(i));
          ccDt.RemovePath(new GH_Path(i));
        }
      }

      ccDtPlines_ = ccDtPlines;
      ccDt_ = ccDt;
      adjDt_ = adjDt;




      //////////////////////////////////////////////////////////////
      //C Get Axes - Construct Zollinger System
      //////////////////////////////////////////////////////////////

      var ccDtLines = new DataTree<Line>();
      var ccDtValid = new DataTree<bool>();
      var ccDtZAxis = new DataTree<Vector3d>();
      var ccDtDir = new DataTree<bool>();
      Zollinger zollinger = new Zollinger();
      var ccZol = new Dictionary<int,int>();
      var ccZol_ = new Dictionary<int,int>();
      for(int i = 0; i < ccDt.Paths.Count;i++) {

        GH_Path p = ccDt.Paths[i];


        //C.1 Get Polyline segments and order align them
        List<Polyline> polylines = new List<Polyline>();

        for(int j = 0; j < ccDt.Branch(p).Count;j++){
          int[] idCur = FEMaskE(ccDt.Branch(p)[j]);//first segment
          polylines.Add(tiles[idCur[0]].geo[idCur[2]][0]);
        }

        polylines = AlignSegments(polylines, 0.1);

        //C.2 Get Direction
        int[] id0 = FEMaskE(ccDt.Branch(p)[0]);//first segment
        bool direction = tiles[id0[0]].eFlag[id0[2]];
        ccDtDir.Add(direction, p);

        //C.3 Get Lines
        Line axis = new Line(polylines.First().First(), polylines.Last().Last());
        ccDtLines.Add(axis, p);

        //C.4 Get Average normal by summing mesh face planes
        Vector3d ZAxis = new Vector3d();

        foreach(string v in ccDt.Branch(p)  ) {
          int[] id = FEMaskE(v);//first segment
          ZAxis += planes[id[0]].ZAxis;
        }

        ccDtZAxis.Add(ZAxis, p);

        //C.5 Construct beam planes
        Plane axisPlane = new Plane(axis.PointAt(0.5), axis.Direction, ZAxis);
        Plane perpPlane = new Plane(axisPlane.Origin, ZAxis, axisPlane.ZAxis);



        //C.6 Append to Zollinger system
        ZollingerBeam zb = new ZollingerBeam(axisPlane, perpPlane, axis, direction, p.Indices[0],Radius0,Radius1);

        ccZol.Add(zollinger.Count, p.Indices[0]);
        ccZol_.Add(p.Indices[0], zollinger.Count);
        zollinger.Add(zb);

      }



      //Change Zollinger planes by neighbour planes
      for(int i = 0; i < zollinger.Count; i++){
        GH_Path p = new GH_Path(zollinger.zb[i].id);
        //Rhino.RhinoApp.WriteLine();
        for(int j = 0; j < adjDt.Branch(p).Count; j++){

          //Get cp point


          int id_ = adjDt.Branch(p)[j];
          int id = ccZol_[id_];
          //Rhino.RhinoApp.WriteLine(zollinger.zb[i].id.ToString() + " " + id.ToString());
          zollinger.zb[i].neighbours.Add(id);
          double t0,t1;
          Rhino.Geometry.Intersect.Intersection.LineLine(zollinger.zb[i].axis, zollinger.zb[id].axis, out t0, out t1, 10000, false);

          if(t0 < 0.2){

            Point3d p0 = NGonsCore.PlaneUtil.LinePlane(zollinger.zb[i].axis, zollinger.zb[id].sidePlanes[1]);
            Point3d p1 = NGonsCore.PlaneUtil.LinePlane(zollinger.zb[i].axis, zollinger.zb[id].sidePlanes[3]);






            zollinger.zb[i].sidePlanes[0] = (p0.DistanceToSquared(zollinger.zb[i].c) < p1.DistanceToSquared(zollinger.zb[i].c)) ? zollinger.zb[id].sidePlanes[1] : zollinger.zb[id].sidePlanes[3];//zollinger.zb[id].axisPlane;
            zollinger.zb[i].sidePlanes[0].Origin = NGonsCore.PlaneUtil.LinePlane(zollinger.zb[i].axis, zollinger.zb[i].sidePlanes[0]);
          }else if(t0 > 0.8){

            Point3d p0 = NGonsCore.PlaneUtil.LinePlane(zollinger.zb[i].axis, zollinger.zb[id].sidePlanes[1]);
            Point3d p1 = NGonsCore.PlaneUtil.LinePlane(zollinger.zb[i].axis, zollinger.zb[id].sidePlanes[3]);



            zollinger.zb[i].sidePlanes[2] = (p0.DistanceToSquared(zollinger.zb[i].c) < p1.DistanceToSquared(zollinger.zb[i].c)) ? zollinger.zb[id].sidePlanes[1] : zollinger.zb[id].sidePlanes[3];//zollinger.zb[id].axisPlane;
            zollinger.zb[i].sidePlanes[2].Origin = NGonsCore.PlaneUtil.LinePlane(zollinger.zb[i].axis, zollinger.zb[i].sidePlanes[2]);


            zollinger.zb[i].sidePlanes[2].Origin = NGonsCore.PlaneUtil.LinePlane(zollinger.zb[i].axis, zollinger.zb[i].sidePlanes[2]);

            //            Plane plane = zollinger.zb[i].sidePlanes[2];
            //            plane.Origin = zollinger.zb[i].axis.PointAt(0.5);
            //             zollinger.zb[i].sidePlanes[2].Origin = NGonsCore.PlaneUtil.LinePlane(zollinger.zb[i].axis, zollinger.zb[i].sidePlanes[2]);

          }




        }

      }









      ccDtLines_ = ccDtLines;
      ccDtZAxis_ = ccDtZAxis;
      ccDtDir_ = ccDtDir;
      pipes_ = zollinger.GetAxes(0);
      pipesPl_ = zollinger.GetPerpPlanes();
      pipesAdj_ = zollinger.GetNeighbours();

      pipesDir_ = zollinger.GetDirections();
      if(Radius0>0&&Radius1>0){
        pipes3d_ = zollinger.GetPipes();
      }
    }catch(Exception e) {
      Print(e.ToString());
    }
# ---------- c_script_3: C# additional code ----------
  public List<Polyline> AlignSegments (List<Polyline> plines, double tol = 0.10){
    List<Polyline> ordered = new List<Polyline>();

    if(plines.Count < 2)
      return plines;

    try{
      //Iterate polyline loop and flip segments, if needed

      //Check first / second segments
      Point3d pt0 = plines[0].First();
      Point3d pt1 = plines[0].Last();

      Point3d pt0Next = plines[1].First();
      Point3d pt1Next = plines[1].Last();

      if( (pt0.DistanceToSquared(pt0Next) < 0.01 || pt0.DistanceToSquared(pt1Next) < 0.01 )){

        ordered.Add(plines[0].Flip());
        pt0 = ordered[0].First();
        pt1 = ordered[0].Last();
      }else{
        ordered.Add(plines[0]);
      }

      //Iterate over all of plines


      for(int j = 1; j < plines.Count;j++){

        Point3d pt0Temp = plines[j].First();

        if(pt1.DistanceToSquared(pt0Temp) > 0.01){
          ordered.Add(plines[j].Flip());
        }else{
          ordered.Add(plines[j]);
        }

        pt0 = ordered[j].First();
        pt1 = ordered[j].Last();

      }
    }catch(Exception e){
      Rhino.RhinoApp.WriteLine(e.ToString());
    }
    return ordered;


  }


  public int[] FEMaskE(string s){
    var txt = s.Split(';');
    int f = Convert.ToInt32(txt[0]);
    int eMask = Convert.ToInt32(txt[1]);
    int e = Convert.ToInt32(txt[2]);
    return new int[]{f,eMask,e};
  }


  BoundingBox bbox;
  public Rhino.Display.Text3d[][] tDisplay;
  public Rhino.Display.Text3d[][] tDisplayEdges;
  public DataTree<Polyline> _tmap;

  public class Zollinger{

    public List<ZollingerBeam> zb = new List<ZollingerBeam>();

    public int Count
    {
      get { return zb.Count; }
      private set {  }  //center_ = value;
    }


    public Zollinger(){

    }

    public void Add(ZollingerBeam b){
      zb.Add(b);
    }

    public DataTree<Plane> GetSidePlanes(){
      var dt = new DataTree<Plane>();

      for(int i = 0; i < zb.Count;i++){
        dt.AddRange(zb[i].sidePlanes, new GH_Path(i));
      }

      return dt;
    }


    public DataTree<Line> GetAxes(double dist = 0){

      var dt = new DataTree<Line>();

      for(int i = 0; i < zb.Count;i++){

        Line line = zb[i].axis;
        Vector3d v = zb[i].basePlane.ZAxis * dist;
        line.Transform(Transform.Translation(v));

        dt.Add(line, new GH_Path(i));

      }

      return dt;
    }

    public DataTree<Plane> GetPerpPlanes(){
      var dt = new DataTree<Plane>();

      for(int i = 0; i < zb.Count;i++){
        dt.Add(zb[i].perpPlane, new GH_Path(i));
      }

      return dt;
    }

    public DataTree<Plane> GetAxisPlanes(){
      var dt = new DataTree<Plane>();

      for(int i = 0; i < zb.Count;i++){
        dt.Add(zb[i].axisPlane, new GH_Path(i));
      }

      return dt;
    }

    public DataTree<Plane> GetBasePlanes(){
      var dt = new DataTree<Plane>();

      for(int i = 0; i < zb.Count;i++){
        dt.Add(zb[i].basePlane, new GH_Path(i));
      }

      return dt;
    }

    public DataTree<Plane> GetTopBottomPlanes(){
      var dt = new DataTree<Plane>();

      for(int i = 0; i < zb.Count;i++){
        dt.AddRange(zb[i].topbotPlanes, new GH_Path(i));
      }

      return dt;
    }

    public DataTree<bool> GetDirections(){
      var dt = new DataTree<bool>();

      for(int i = 0; i < zb.Count;i++){
        dt.Add(zb[i].dir, new GH_Path(i));
      }

      return dt;
    }

    public DataTree<Polyline> GetOutlines(){
      var dt = new DataTree<Polyline>();

      for(int i = 0; i < zb.Count;i++){
        Polyline pl0 = NGonsCore.PolylineUtil.PolylineFromPlanes(zb[i].topbotPlanes[0], zb[i].sidePlanes.ToList(), true);
        Polyline pl1 = NGonsCore.PolylineUtil.PolylineFromPlanes(zb[i].topbotPlanes[1], zb[i].sidePlanes.ToList(), true);
        dt.Add(pl0, new GH_Path(i));
        dt.Add(pl1, new GH_Path(i));
      }

      return dt;
    }

    public DataTree<int> GetNeighbours(){
      var dt = new DataTree<int>();

      for(int i = 0; i < zb.Count;i++){
        dt.AddRange(zb[i].neighbours, new GH_Path(i));
      }

      return dt;
    }

    public DataTree< Curve> GetPipes(){
      var dt = new DataTree<Curve>();

      for(int i = 0; i < zb.Count;i++){

//        Line line = new Line(zb[i].axis.From, zb[i].axis.To);
//        line.Transform(Transform.Scale(zb[i].c, 2));
//        Brep b = Rhino.Geometry.Brep.CreatePipe(line.ToNurbsCurve(), zb[i].r, false, PipeCapMode.None, false, 0.01, 0.01)[0];
//
//        Curve[] crvs;
//        Point3d[] pts;
//        Rhino.Geometry.Intersect.Intersection.BrepPlane(b, zb[i].sidePlanes[0], 0.01, out crvs, out pts);
//        Curve c0 = crvs[0].DuplicateCurve();
//        Rhino.Geometry.Intersect.Intersection.BrepPlane(b, zb[i].sidePlanes[2], 0.01, out crvs, out pts);
//        Curve c1 = crvs[0].DuplicateCurve();
//        c1 = NGonsCore.CurveUtil.GuideCurveDirection(c0, c1);


       
               Polyline c0 = NGonsCore.PolylineUtil.PolylineFromPlanes(zb[i].topbotPlanes[0], zb[i].sidePlanes.ToList(), true);
               Polyline c1 = NGonsCore.PolylineUtil.PolylineFromPlanes(zb[i].topbotPlanes[1], zb[i].sidePlanes.ToList(), true);
        dt.Add(c0.ToNurbsCurve(), new GH_Path(i));
        dt.Add(c1.ToNurbsCurve(), new GH_Path(i));
      }

      return dt;
    }






  }

  public class ZollingerBeam {

    public int id = 0;
    public Plane axisPlane = new Plane();
    public Plane perpPlane = new Plane();
    public Line axis = Line.Unset;
    public Plane[] sidePlanes = new Plane[4];

    public Plane basePlane = new Plane();
    public Plane[] topbotPlanes = new Plane[2];
    public List<int> neighbours = new List<int>();

    public bool dir = false;


    public double r0 = 10;
      public double r1 = 10;

    //private Point3d center_;
    public Point3d c
    {
      get { return axis.PointAt(0.5); }
      private set {  }  //center_ = value;



    }

    public ZollingerBeam(Plane axisPlane, Plane perpPlane, Line axis, bool dir, int id,double r0, double r1){
      this.r0 = r0;
      this.r1 = r1;
      this.axisPlane = axisPlane;
      this.perpPlane = perpPlane;
      this.axis = axis;
      this.dir = dir;
      this.id = id;

      sidePlanes[0] = perpPlane.ChangeOrigin(axis.From);
      sidePlanes[1] = axisPlane.MovePlanebyAxis(r0);
      sidePlanes[2] = perpPlane.ChangeOrigin(axis.To);
      sidePlanes[3] = axisPlane.MovePlanebyAxis(-r0);

      basePlane = new Plane(axisPlane.Origin, axisPlane.XAxis, axisPlane.ZAxis);
      topbotPlanes[0] = basePlane.MovePlanebyAxis(r1);
      topbotPlanes[1] = basePlane.MovePlanebyAxis(-r1);

    }

  }


  public void GetDisplay(int f, Polyline pline, Plane plane, Tile2D t, int eCount){
    Polyline scalePline = pline.Duplicate();
    scalePline.Transform(Transform.Scale(plane.Origin, 0.65));
    Rhino.Display.Text3d[] txt = new Rhino.Display.Text3d[pline.SegmentCount];
    Rhino.Display.Text3d[] txtEdges = new Rhino.Display.Text3d[pline.SegmentCount];

    for(int i = 0; i < pline.SegmentCount; i++){
      Plane textPlane = new Plane(plane);
      textPlane.Origin = scalePline.PointAt(i + 0.5);
      textPlane.Flip();
      textPlane.Rotate(Math.PI, textPlane.ZAxis);
      Rhino.Display.Text3d entity = new Rhino.Display.Text3d((eCount + i).ToString(), new Plane(textPlane), 30);

      if(    t.geo[i].Count > 0){
        textPlane.Origin = t.geo[i][0].PointAt(0.5);
        string LineText = f.ToString() + ";" + t.e[i].ToString() + ";" + i.ToString();
        //Rhino.Display.Text3d entityEdge = new Rhino.Display.Text3d((eCount + i).ToString(), textPlane, 200);
        Rhino.Display.Text3d entityEdge = new Rhino.Display.Text3d(LineText, textPlane, 30);
        txtEdges[i] = entityEdge;
      }

      txt[i] = entity;

    }

    tDisplay[f] = txt;
    tDisplayEdges[f] = txtEdges;

  }



  public  int[] CommonEdge(Mesh M, int F0, int F1) {

    int[] e0 = M._fe(F0);
    int[] e1 = M._fe(F1);


    var common = e0.Intersect(e1);

    if (common.Count() > 0){

      int commonEdge = common.First();

      int a = 0;
      int b = 0;

      for(int i = 0; i < e0.Length; i++){
        if(commonEdge == e0[i]){
          a = i;
          break;
        }
      }

      for(int i = 0; i < e1.Length; i++){
        if(commonEdge == e1[i]){
          b = i;
          break;
        }
      }

      return new int[]{a,b};


    }else
      return new int[]{-1,-1};
  }


  //Return a BoundingBox that contains all the geometry you are about to draw.
  public override BoundingBox ClippingBox
  {
    get
    {
      return bbox;
    }
  }

  //Draw all meshes in this method.
  public override void DrawViewportMeshes(IGH_PreviewArgs args)
  {
  }

  //Draw all wires and points in this method.
  public override void DrawViewportWires(IGH_PreviewArgs args)
  {
    //
    //    foreach(var l in this._tmap.AllData()){
    //      args.Display.DrawArrow(new Line(l[0], l[l.Count - 1]), System.Drawing.Color.Black);
    //    }


    foreach(var array in tDisplay){
      if(array != null){
        foreach(var element in array){
          args.Display.Draw3dText(element, System.Drawing.Color.Black);
        }
      }
    }

    foreach(var array in tDisplayEdges){
      if(array != null){
        foreach(var element in array){
          if(element != null){
            args.Display.Draw3dText(element, System.Drawing.Color.OrangeRed);
          }
        }
      }
    }

  }
# ---------- end c_script_3 ----------

# ----
mesh_2 = Mesh(flatten(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))

# ----
# CONVERT IT INTO
# A KARAMBA MATERIAL
b2kmat = BeaverToKarambaMaterial(BeaverMaterial=item)

medges_2 = MeshEdges(Mesh=mesh_2)  # -> NakedEdges, InteriorEdges, NonManifoldEdges
crv_2 = Curve(<curve referenced from the Rhino model>)
panel_2 = Panel("internal")
Z = UnitZ(Factor="-1.5")

# ---- group: Adjacency
crv_3 = Curve(reparameterize(c_script_3.pipes))
branch = TreeBranch(Tree=crv_3, Path="100", MaintainPaths=True)
branch_2 = TreeBranch(Tree=c_script_3.pipesAdj, Path="100", MaintainPaths=True)
branch_3 = TreeBranch(Tree=crv_3, Path=branch_2, MaintainPaths=True)
display = CurvePreview(Curve=branch_3, Width=10, Colour=RGB(0, 0, 0))
display_2 = CurvePreview(Curve=branch, Width=10, Colour=RGB(255, 0, 0))
display_3 = CurvePreview(Curve=crv_3, Width=2, Colour=RGB(0, 0, 0))

# ----
beam_loads = BeamLoadsKaramba3D(LoadCase="P", ForceVector=Z, TStart=0, TEnd=1, mode="Block", menu=[buttons(off, off, on)])
cross_section = CrossSectionKaramba3D(
    FamilyNameOfCrossSection="DefaultCroSec",
    Material=b2kmat,
    Height_cm="10",
    UpperFlangeWidth_cm="4.8",
    LowerFlangeWidth_cm="4.8",
    mode="Trapezoid")
item_2 = ListItem(List=c_script_3.pipes3d, Index=0, Wrap=True)  # -> Item, Item1

# ---- group: For Joinery Solver
c_script_4 = CSharpScript(L=flatten(crv_3), N=c_script_3.pipesAdj, MaxDist="2")  # -> out, A, B; inputs L: list of Line, N: tree of Int32, MaxDist: Double
# ---------- c_script_4: C# usings ----------
using System.Linq;
# ---------- c_script_4: C# ----------
    List<Line> LCopy = new List<Line>(L);
    List<List<double>> LineParameters = new List<List<double>>(L.Count);
    for(int i = 0; i < L.Count; i++){
      LineParameters.Add(new List<double>());
    }




    DataTree < Line > connections = new DataTree<Line>();

    for(int i = 0; i < N.BranchCount; i++){
      Line l0 = L[i];
      for(int j = 0; j < N.Branch(i).Count; j++){

        Line l1 = L[N.Branch(i)[j]];

        double t0, t1;

        Rhino.Geometry.Intersect.Intersection.LineLine(l0, l1, out t0, out t1, 1000, false);
        Point3d p0 = l0.PointAt(t0);
        Point3d p1 = l1.PointAt(t1);

        if(p0.DistanceTo(p1) < MaxDist){

          LineParameters[i].Add(t0);
          LineParameters[N.Branch(i)[j]].Add(t1);


          connections.Add(new Line(l0.PointAt(t0), l1.PointAt(t1)), new GH_Path(i));
        }




      }

    }


    for(int i = 0; i < LineParameters.Count; i++){
      
      double[] t = LineParameters[i].ToArray();
      Array.Sort(t);
      
      if(t.Length > 0){
      
        List < double > tClean = new List<double>(LineParameters[i].Count){t[0]};
        
        for (int j = 1; j < t.Length; j++)
          if(Math.Abs(tClean[tClean.Count - 1] - t[j]) > 0.01 )
            tClean.Add(t[j]);
        
        Print(tClean.Count.ToString());
        
          
   
      

      
        if(tClean.Count == 1){
          //Print("hi");
          
          if( Math.Abs(t[0] - 0) > Math.Abs(t[0] - 1) ){
            LCopy[i] = new Line( LCopy[i].PointAt(0),LCopy[i].PointAt(t[0]));
          }else{
            LCopy[i] = new Line(LCopy[i].PointAt(t[0]), LCopy[i].PointAt(1));
          }
        
        }else {
          LCopy[i] = new Line(LCopy[i].PointAt(tClean[0]), LCopy[i].PointAt(tClean[tClean.Count - 1]));
        }
        
      }//more than 1
      
    }//for i


    A = connections;
    B = LCopy;
# ---------- end c_script_4 ----------

# ----
loftholes = LoftHoles(Polylines0=item_2.Item, Polylines1=item_2.Item1)  # -> Mesh, Mesh_2
ngonpreview = NGonPreview(Mesh=loftholes.Mesh, LineColor=RGB(0, 0, 0))
crv_4 = Curve(c_script_4.B)
surface = Surface(<surface referenced from the Rhino model>)
crv_5 = Curve(flatten(c_script_3.ccDtPlines))
lng = ListLength()
llinter = LineLineIntersectionKaramba3D(Line=crv_5, LimitDistance_m="0.01")  # -> IntersectionPoints, LineSubSegements
end = EndPoints(Curve=llinter.LineSubSegements)  # -> Start, End
pt = Point([end.Start, end.End])
midpt = CurveMiddle(Curve=llinter.LineSubSegements)
pt_2 = Point(Point(0.2873859572, -9.742684996, 0))
duppt = RemoveDuplicatePts(Points=pt, Tolerance="0.01")  # -> flatten(UniquePoints)
pt_3 = Point(Point(0.2873859572, 0.2573150043, 0))
pdecon = Deconstruct(Point=pt_2)  # -> XComponent, YComponent, ZComponent
pdecon_2 = Deconstruct(Point=pt_3)  # -> XComponent, YComponent, ZComponent
pdecon_3 = Deconstruct(Point=duppt)  # -> XComponent, YComponent, ZComponent
panel_3 = Panel("-9.473")
srf_cp = SurfaceClosestPoint(Point=midpt, Surface=surface)  # -> Point, UVPoint, Distance
equalst = EqualityWithinTolerance(FirstNumber=pdecon_3.YComponent, SecondNumber=pdecon.YComponent, Tolerance="0.05")  # -> Equality, Inequality
cull = CullPattern(List=duppt, CullPattern=equalst.Equality)
equalst_2 = EqualityWithinTolerance(FirstNumber=pdecon_3.YComponent, SecondNumber=pdecon_2.YComponent, Tolerance="0.01")  # -> Equality, Inequality
cull_2 = CullPattern(List=duppt, CullPattern=equalst_2.Equality)
smaller = SmallerThan(FirstNumber=pdecon_3.ZComponent, SecondNumber="0.05")  # -> SmallerThan, OrEqualTo
cull_3 = CullPattern(List=duppt, CullPattern=smaller.SmallerThan)
evalsrf = EvaluateSurface(Surface=surface, Point=srf_cp.UVPoint)  # -> Point, Normal, UDirection, VDirection, Frame
duppt_2 = RemoveDuplicatePts(Points=[cull, pt_2], Tolerance=0.01)
duppt_3 = RemoveDuplicatePts(Points=[cull_2, pt_3], Tolerance=0.01)
panel_4 = Panel("""P
QA
W""")
pt_4 = Point(flatten(duppt_2))
pt_5 = Point(flatten(duppt_3))
vec = Vector(evalsrf.Normal)
sort_pt = SortPoints(Points=pt_4)  # -> Points, Indices
pline = PolyLine(Vertices=sort_pt.Points, Closed=False)
vdis = VectorDisplay(Anchor=midpt, Vector=vec)
sort_pt_2 = SortPoints(Points=pt_5)  # -> Points, Indices
pline_2 = PolyLine(Vertices=sort_pt_2.Points, Closed=False)
crv_6 = Curve(flatten(llinter.LineSubSegements))
explode = Explode(Curve=pline, Recursive=True)  # -> Segments, Vertices
explode_2 = Explode(Curve=pline_2, Recursive=True)  # -> Segments, Vertices
type = ValueList({"All", "SLS", "AllULS", "Tension", "Compression", "BiaxialBending", "Shear", "Torsion", "TensionAndBending", "CompressionAndBending", "CompressionAndBendingColumn", "CompressionAndBendingBeam", "TorsionAndShear"}, selected="Shear")
value_list = ValueList({"All", "Y", "Z"}, selected="All")
value_list_2 = ValueList({"All", "Y", "Z"}, selected="All")
value_list_3 = ValueList({"All", "Y", "Z"}, selected="All")
value_list_4 = ValueList({"All", "Y", "Z"}, selected="All")
value_list_5 = ValueList({"All": -1, "G": 0, "1.35G": 1}, selected="All")
value_list_6 = ValueList({"All": -1, "G": 0, "1.35G": 1}, selected="All")
value_list_7 = ValueList({"All": -1, "G": 0, "1.35G": 1}, selected="All")
value_list_8 = ValueList({"All": -1, "G": 0, "1.35G": 1}, selected="All")
duppt_4 = RemoveDuplicatePts(Points=cull_3, Tolerance=0.01)
crv_7 = Curve(flatten([crv_6, explode_2.Segments, explode.Segments]))
crv_8 = Curve(flatten(crv_7))
lng_2 = ListLength(List=crv_8)
len = Length(Curve=crv_8)  # -> flatten(Length)
repeat = RepeatData(Data=crv_2, Length=lng_2)
linetobeam = LineToBeamKaramba3D(
    Line=crv_8,
    CrossSection=cross_section,
    New=True,
    Remove=True,
    LimitDistance_m=0.005,
    Bending=True,
    SetBucklingLength=True,
    ToPolylineMaxAngle=0.03,
    ToPolylineTolerance=0.01,
    ToPolylineMinEdgeLength=0.25)  # -> Element, Points, Info
# ADD BEAVER
# PARAMETERS
# TO ELEMENTS
addbeaverparams = KarambaAddBeaverParameters(
    Beam=linetobeam.Element,
    SpanLength=repeat,
    BucklingLengthY=len,
    BucklingLengthZ=len,
    BucklingLengthLT=len,
    Cantilever=False,
    ServiceClass=2,
    Precamber="500",
    Local=False)
lng_3 = ListLength(List=addbeaverparams)
addition = Addition(A=lng_3, B=lng)
series = Series(Start=0, Step=1, Count=addition)
len_2 = Length(Curve=crv_6)
crv_9 = Curve([crv_6, explode_2.Segments, explode.Segments])
pt_6 = Point(duppt_4)
pt_7 = Point(pt_6)
supp = SupportKaramba3D(PosInd=pt_7, menu=[buttons(on, on, on, off, off, off)])
# RUN
# KARAMBA ANALYSIS
assemble = AssembleModelKaramba3D(Elem=addbeaverparams, Support=supp, Load=beam_loads, LimitDistance_m=0.005)  # -> Model, Info, Mass_kg, CenterOfGravity, LoadCaseNames
analyze = AnalyzeKaramba3D(Model=assemble.Model)  # -> CalculatedModel, MaximumDisplacement_cm, ResultingForceOfGravity_kN, ElasticEnergyChange_kNm
# DISPLAY KARAMBA RESULTS
modelview = ModelViewKaramba3D(Model=analyze.CalculatedModel, ResultFactors=1, ResultCase=-1)  # -> Model, DeformedMesh, DeformedAxes, DeformedModel

# ----
# BEAVER
# IMPORT TO BEAVER
panel_5 = Panel("P")
k2b = KarambaToBeaver(
    KarambaModel=analyze.CalculatedModel,
    BeamIdentifiers=series,
    NumberOfResultsPerBeamElement="2",
    LoadCaseType=panel_5,
    Run=Toggle(False))

beamview = BeamViewKaramba3D(Model=modelview.Model)  # -> Model, MeshesOfRenderedBeams, DeformedBeamAxes, LegendColors, LegendTags; disabled
legend = Legend(
    Colour=beamview.LegendColors,
    Tags=beamview.LegendTags,
    Rectangle={Plane=PlaneXY(-10.2767964, 8.52262475, 0), Size=Domain2(u=-1.919640395..1.919640395, v=-5.028908498..5.028908498)},
    LegendType=1)
nickname_2 = TimberFrameView(TimberFrames=k2b, UtilizationType=type)  # -> TimberFrames, Mesh, LegendT, LegendC, MaximumUtilization
criticalcheck = VisualizeCriticalCheck(TimberFrames=k2b)  # -> TimberFrames, Mesh, LegendT, LegendC
smaller_2 = SmallerThan(FirstNumber=len_2, SecondNumber="0.1")  # -> SmallerThan, OrEqualTo
dispatch = Dispatch(List=crv_6, DispatchPattern=smaller_2.SmallerThan)  # -> ListA, ListB
crv_10 = Curve(dispatch.ListA)
crv_11 = Curve(dispatch.ListB)
join = JoinCurves(Curves=crv_11, Preserve=False)
rad = Radians(Degrees="10")
join_2 = JoinCurves(Curves=crv_10, Preserve=False)
Z_2 = UnitZ(Factor=Slider(0, range=0..6))
data = Data(nickname_2.TimberFrames)
mesh_3 = Mesh(nickname_2.Mesh)
txt = Text(nickname_2.LegendT)
col = Colour(nickname_2.LegendC)
splitatcorners = SplitAtCorners(Poly=join, Angle=rad)  # -> Corners, flatten(Parts)
reb = RebuildCurve(Curve=join_2, Degree=1, Count=2, Tangents=False)
move = Move(Geometry=mesh_3, Motion=Z_2)  # -> Geometry, Transform
list = ValueList({"Utilization", "Critical Check"}, selected="Utilization")
panel_6 = Panel("""0
1
2
3""")
sift = SiftPattern(List=splitatcorners.Parts, SiftPattern=panel_6)  # -> Output0, Output1, Output2, Output3
numericresults = ViewNumericResults(
    TimberFrames=data,
    ValueType=list,
    TextColour=ColourSwatch(SwatchColor=RGB(82, 82, 82)),
    TextSize=Slider(0.064, range=0..1))  # -> Info, Points, Report
medges_3 = MeshEdges(Mesh=move.Geometry)  # -> NakedEdges, InteriorEdges, NonManifoldEdges
crv_12 = Curve(sift.Output3)
crv_13 = Curve(sift.Output0)
crv_14 = Curve(sift.Output2)
crv_15 = Curve(sift.Output1)
crv_16 = Curve([medges_3.NakedEdges, medges_3.InteriorEdges, medges_3.NonManifoldEdges])
tag = TextTag(Location=numericresults.Points, Text=numericresults.Info)
entwine = Entwine(Branch00=crv_13, Branch01=crv_15, Branch02=crv_14, Branch03=crv_12, FlattenInputs=True)
preview = CustomPreview(Geometry=crv_16, Material=ColourSwatch(SwatchColor=RGB(171, 171, 171)))
clean = CleanTree(RemoveNulls=True, RemoveInvalid=True, RemoveEmpty=False, Tree=entwine)
reb_2 = RebuildCurve(Curve=join_2, Degree=1, Count=2, Tangents=False)
reb_3 = RebuildCurve(Curve=clean, Degree=1, Count=2, Tangents=False)

# ----
# LEGEND
expression = Expression(x=nickname_2.MaximumUtilization, Expression="Format(\"{0}{1:0,#} {2}\",\"Max Utilization: \", x*100,\"%\")")
txt_2 = Text(txt)
col_2 = Colour(col)
launchxpwin = LaunchTransparentWindow(Show=Toggle(True), Name="Legend", Width=370, Height=500, ChildStatus=0, EnableHorizScroll=False)
textbox = CreateTextBox(DefaultText=txt_2, UpdateButton=False, showLabel=True)
label = CreateLabel(LabelText=expression, LabelSize=12, Justification=0)
c_script_5 = CSharpScript(x=col_2)  # -> A; inputs x: list of Color
# ---------- c_script_5: C# usings ----------
using System.Drawing;
# ---------- c_script_5: C# ----------
    List<Color> out_colors = new List<Color>();
    foreach(Color colorL in x){
      Color out_color = colorL.GetBrightness() > 0.4 ? Color.Black : Color.White;
      out_colors.Add(out_color);
    }
    A = out_colors;
# ---------- end c_script_5 ----------
panel_7 = Panel("25,100")
addelems = AddElements(Window=launchxpwin, Elements=flatten([textbox, label]), DoVLChecking=True)  # -> AddedElements, ElementNames
winprops = SetWindowProperties(Window=launchxpwin, ShowTitleBar=Toggle(True), ScaleFactor=Slider(0.7, range=0..1))
adjustelem = AdjustElementAppearance(ElementsToAdjust=textbox, Foreground=c_script_5, Background=col_2, FontSize=Slider(18, range=0..100))

# ==== cluster Cluster
C = ClusterInput()
explode = Explode(Curve=C, Recursive=True)  # -> Segments, Vertices
curvepoint = PointOnCurve(explode.Segments, parameter=0.5)
points = PointList(Points=curvepoint, Size=Slider(0.318, range=0..100))
