# Grasshopper definition marcinho.gh (Grasshopper 1.0.7)
# plug-ins: Kangaroo2 Components

number_slider = Slider(0, range=0..10)
xz = XZPlane(Origin=Point(0, 0, 0))
xz_2 = XZPlane(Origin=Point(0, 0, 0))
xy = XYPlane(Origin=Point(0, 0, 0))
Z = UnitZ(Factor=number_slider)
yz = YZPlane(Origin=Point(0, 0, 0))
xy_2 = XYPlane(Origin=Point(0, 0, 0))
rad = Radians(Degrees=Slider(0, range=-90..90))
rad_2 = Radians(Degrees=Slider(47, range=0..90))
move = Move(Geometry=xy, Motion=Z)  # -> Geometry, Transform
move_2 = Move(Geometry=xy_2, Motion=Z)  # -> Geometry, Transform
cir = Circle(Plane=xz, Radius=Slider(2, range=0..10))
rotate = Rotate(Geometry=cir, Angle=rad, Plane=yz)  # -> Geometry, Transform
rotate_2 = Rotate(Geometry=move_2.Geometry, Angle=rad_2, Plane=move.Geometry)  # -> Geometry, Transform
cir_2 = Circle(Plane=rotate_2.Geometry, Radius=Slider(7, range=0..10))
loft = Loft(
    Curves=[cir_2, rotate.Geometry],
    Options={Adjust=False, Closed=False, LoftEnds=0, LoftSimp=0, LoftType=0, Rebuild=10, Refit=0.01})
mesh_uv = MeshSurface(Surface=loft, UCount=Slider(6, range=0..10), VCount=Slider(30, range=0..30), Overhang=True, Equalize=False)
diag = Diagonalize(Mesh=mesh_uv)
nv = NakedVertices(Mesh=diag)  # -> ClothedIndex, NakedIndex, ClothedPts, NakedPts
medges = MeshEdges(Mesh=diag)  # -> NakedEdges, InteriorEdges, NonManifoldEdges
pt = Point([nv.ClothedPts, nv.NakedPts])
panel = Panel(number_slider)
crv_cp = CurveClosestPoint(Point=pt, Curve=cir_2)  # -> Point, Parameter, Distance
crv_cp_2 = CurveClosestPoint(Point=pt, Curve=rotate.Geometry)  # -> Point, Parameter, Distance
smaller = SmallerThan(FirstNumber=crv_cp_2.Distance, SecondNumber="0.01")  # -> SmallerThan, OrEqualTo
smaller_2 = SmallerThan(FirstNumber=crv_cp.Distance, SecondNumber="0.01")  # -> SmallerThan, OrEqualTo
cull = CullPattern(List=pt, CullPattern=smaller.SmallerThan)
cull_2 = CullPattern(List=pt, CullPattern=smaller_2.SmallerThan)
edgelengths = EdgeLengths(Mesh=diag, LengthFactor="0", Strength=1)
anchor = Anchor(Point=[cull, cull_2], Strength=10000)
show = Show(G=diag)
bouncysolver = BouncySolver(
    GoalObjects=[anchor, edgelengths, show],
    Reset=Button(),
    Threshold=1e-15,
    Tolerance=0.0001,
    Damping=0.99,
    Iterations=10,
    On=Toggle(False))  # -> I, V, O
mesh = Mesh(bouncysolver.O)
crv = Curve(bouncysolver.O)
